# Grasshopper definition 261006 EOC vr Incident Radiation_HB - 1.10_Context_Zones_Heatmap_v2.gh (Grasshopper 1.0.8)
# plug-ins: Karamba3D, Human, LadybugGrasshopper, MetaHopper, Telepathy

pipeline = GeometryPipeline(
    GroupByLayer=False,
    GroupByType=False,
    IncludeHidden=True,
    IncludeLocked=True,
    LayerFilter="EOC::Glazed Facade::North",
    NameFilter="*",
    SublayerFiltering=True,
    TypeFilter=1073741848)
geo = Geometry(pipeline)
geo_2 = Geometry(geo)
area = Area(Geometry=geo_2)  # -> Area, Centroid
pdecon = Deconstruct(Point=area.Centroid)  # -> XComponent, YComponent, ZComponent
sort = SortList(Keys=pdecon.XComponent, ValuesA=geo_2)  # -> Keys, ValuesA
sift = SiftPattern(List=sort.ValuesA, SiftPattern=[0, 1, 0])  # -> Output0, Output1
Z = UnitZ(Factor="5")
crv = Curve([<curve referenced from the Rhino model> x4])
srf = Surface(reparameterize(sift.Output1))
extr = Extrude(Base=crv, Direction=Z)
graft = GraftTree(Tree=sift.Output0, IncludeEmptyLists=True, IncludeNullItems=True)
pipeline_2 = GeometryPipeline(
    GroupByLayer=False,
    GroupByType=False,
    IncludeHidden=True,
    IncludeLocked=True,
    LayerFilter="EOC::Glazed Facade::West",
    NameFilter="*",
    SublayerFiltering=True,
    TypeFilter=1073741848)
pipeline_3 = GeometryPipeline(
    GroupByLayer=False,
    GroupByType=False,
    IncludeHidden=True,
    IncludeLocked=True,
    LayerFilter="EOC::Glazed Facade::East",
    NameFilter="*",
    SublayerFiltering=True,
    TypeFilter=1073741848)
splitmul = SplitBrepMultiple(Brep=srf, Cutters=extr)  # -> reverse(Result)
partition = PartitionList(List=flatten(splitmul), Size=[1, 3, 1])
geo_3 = Geometry(pipeline_2)
geo_4 = Geometry(pipeline_3)
debrep = DeconstructBrep(Brep=partition)  # -> simplify(Faces), Edges, Vertices
entwine = Entwine(Branch00=geo_3, Branch02=geo_4, FlattenInputs=True)
join = JoinCurves(Curves=debrep.Edges, Preserve=False)
boundary = BoundarySurfaces(Edges=join)
pshift = ShiftPaths(Data=boundary, Offset=-2)
clean = CleanTree(RemoveNulls=True, RemoveInvalid=True, RemoveEmpty=True, Tree=entwine)
clean_2 = CleanTree(RemoveNulls=True, RemoveInvalid=True, RemoveEmpty=True, Tree=graft)
merge = Merge(Data1=clean, Data2=clean_2, Data3=pshift)
tstat = TreeStatistics(Tree=merge)  # -> Paths, Length, Count
item = ListItem(List=tstat.Paths, Index=Slider(1, range=0..10), Wrap=True)
split = SplitTree(Data=merge, Masks=flatten(item))  # -> graft(Positive), Negative
group = Group(Geometry=split.Negative)  # -> graft(Group)

geo_5 = Geometry([<surface referenced from the Rhino model>, <brep referenced from the Rhino model>])  # disabled
debrep_2 = DeconstructBrep(Brep=geo_5)  # -> Faces, Edges, Vertices; disabled
geo_6 = Geometry(debrep_2.Edges)  # disabled
midpt = CurveMiddle(Curve=geo_6)  # disabled
pdecon_2 = Deconstruct(Point=midpt)  # -> XComponent, YComponent, ZComponent; disabled
sort_2 = SortList(Keys=pdecon_2.ZComponent, ValuesA=geo_6)  # -> Keys, ValuesA; disabled
item_2 = ListItem(List=sort_2.ValuesA, Index=0, Wrap=True)  # -> flatten(Item); disabled
number_slider = Slider(3, range=0..10)  # disabled
join_2 = JoinCurves(Curves=item_2, Preserve=False)  # disabled
divide = DivideCurve(Curve=join_2, Count=number_slider, Kinks=False)  # -> Points, Tangents, Parameters; disabled
pframe = PerpFrame(Curve=join_2, Parameter=divide.Parameters)  # disabled
cull_i = CullIndex(List=pframe, Indices=[0, -1], Wrap=True)  # disabled
planesrf = PlaneSurface(Plane=cull_i, XSize=Domain(-10, 10), YSize=Domain(-10, 10))  # disabled
splitmul_2 = SplitBrepMultiple(Brep=geo_5, Cutters=planesrf)  # disabled
area_2 = Area(Geometry=splitmul_2)  # -> Area, Centroid; disabled
sort_pt = SortPoints(Points=area_2.Centroid)  # -> Points, Indices; disabled
item_3 = ListItem(List=splitmul_2, Index=sort_pt.Indices, Wrap=True)  # -> simplify(graft(Item)); disabled
debrep_3 = DeconstructBrep(Brep=item_3)  # -> Faces, Edges, Vertices; disabled

geo_7 = Geometry([<surface referenced from the Rhino model>, <brep referenced from the Rhino model>])  # disabled
area_3 = Area(Geometry=geo_7)  # -> Area, Centroid; disabled
pdecon_3 = Deconstruct(Point=area_3.Centroid)  # -> XComponent, YComponent, ZComponent; disabled
sort_3 = SortList(Keys=pdecon_3.ZComponent, ValuesA=geo_7)  # -> Keys, ValuesA; disabled
item_4 = ListItem(List=sort_3.ValuesA, Index=0, Wrap=True)  # -> Item, Item1; disabled
edges = BrepEdges(Brep=item_4.Item1)  # -> Naked, Interior, NonManifold; disabled
debrep_4 = DeconstructBrep(Brep=item_4.Item)  # -> Faces, Edges, Vertices; disabled
number_slider_2 = Slider(0.03, range=0..1)  # disabled
number_slider_3 = Slider(0, range=0..1)  # disabled
geo_8 = Geometry(debrep_4.Edges)  # disabled
join_3 = JoinCurves(Curves=edges.Naked, Preserve=False)  # disabled
data = Data(join_3)  # disabled
midpt_2 = CurveMiddle(Curve=geo_8)  # disabled
project = Project(Geometry=data, Plane=PlaneXY(0, 0, 0))  # -> Geometry, Transform; disabled
pdecon_4 = Deconstruct(Point=midpt_2)  # -> XComponent, YComponent, ZComponent; disabled
simplify = SimplifyCurve(Curve=project.Geometry)  # -> Curve, Simplified; disabled
sort_4 = SortList(Keys=pdecon_4.YComponent, ValuesA=geo_8)  # -> Keys, ValuesA; disabled
item_5 = ListItem(List=simplify.Curve, Index=0, Wrap=True)  # disabled
disc = Discontinuity(Curve=simplify.Curve, Level=1)  # -> Points, Parameters; disabled
item_6 = ListItem(List=sort_4.ValuesA, Index=0, Wrap=True)  # disabled

ungroup = Ungroup(Group=group)
pshift_2 = ShiftPaths(Data=ungroup, Offset=-1)
merge_2 = Merge(Data1=split.Positive, Data2=pshift_2)

# ---- group: OVERHANG DEPTH SWITCH
# OVERHANG DEPTH SWITCH
# Pick the depth in 'Overhang D'. It selects the Roof + Context Wall layers of that depth (Rhino layers EOC::D###::...),
# names the HB model Radiation_HB_Model_D#### (own simulation folder) and points 'Results folder' to it.
overhang_d = ValueList({"D0000  (D00)": 0, "D0500  (D500)": 1, "D0750  (D750)": 2, "D1000  (D1000)": 3, "D1250  (D1250)": 4, "D1500  (D1500)": 5, "D1130  (Architect's option)": 6}, selected="D0000  (D00)")
pipeline_4 = GeometryPipeline(
    GroupByLayer=False,
    GroupByType=False,
    IncludeHidden=True,
    IncludeLocked=True,
    LayerFilter="EOC::D00::Roof",
    NameFilter="*",
    SublayerFiltering=True,
    TypeFilter=1073741848)
pipeline_5 = GeometryPipeline(
    GroupByLayer=False,
    GroupByType=False,
    IncludeHidden=True,
    IncludeLocked=True,
    LayerFilter="EOC::D500::Roof",
    NameFilter="*",
    SublayerFiltering=True,
    TypeFilter=1073741848)
pipeline_6 = GeometryPipeline(
    GroupByLayer=False,
    GroupByType=False,
    IncludeHidden=True,
    IncludeLocked=True,
    LayerFilter="EOC::D750::Roof",
    NameFilter="*",
    SublayerFiltering=True,
    TypeFilter=1073741848)
pipeline_7 = GeometryPipeline(
    GroupByLayer=False,
    GroupByType=False,
    IncludeHidden=True,
    IncludeLocked=True,
    LayerFilter="EOC::D1000::Roof",
    NameFilter="*",
    SublayerFiltering=True,
    TypeFilter=1073741848)
pipeline_8 = GeometryPipeline(
    GroupByLayer=False,
    GroupByType=False,
    IncludeHidden=True,
    IncludeLocked=True,
    LayerFilter="EOC::D1250::Roof",
    NameFilter="*",
    SublayerFiltering=True,
    TypeFilter=1073741848)
pipeline_9 = GeometryPipeline(
    GroupByLayer=False,
    GroupByType=False,
    IncludeHidden=True,
    IncludeLocked=True,
    LayerFilter="EOC::D1500::Roof",
    NameFilter="*",
    SublayerFiltering=True,
    TypeFilter=1073741848)
pipeline_10 = GeometryPipeline(
    GroupByLayer=False,
    GroupByType=False,
    IncludeHidden=True,
    IncludeLocked=True,
    LayerFilter="EOC::D1130::Roof",
    NameFilter="*",
    SublayerFiltering=True,
    TypeFilter=1073741848)
filter = StreamFilter(
    Gate=overhang_d,
    Stream0=pipeline_4,
    Stream1=pipeline_5,
    Stream2=pipeline_6,
    Stream3=pipeline_7,
    Stream4=pipeline_8,
    Stream5=pipeline_9,
    Stream6=pipeline_10)

model_name_prefix = Panel("Radiation_HB_Model_")
run_labels = Panel("""D0000
D0500
D0750
D1000
D1250
D1500
D1130""")
item_7 = ListItem(List=run_labels, Index=overhang_d, Wrap=True)
run_label_excel_sheet = Panel(item_7)
concat = Concatenate(FragmentA=model_name_prefix, FragmentB=item_7)
simulation_folder = Panel("C:\Users\Vishnu\simulation\DFF-context-zones\")
results_sub_folder = Panel("\annual_irradiance\results\total")
concat_2 = Concatenate(FragmentA=simulation_folder, FragmentB=concat, FragmentC=results_sub_folder)

# ----
cs = CSharpScript(T=merge_2, i=Slider(4, range=0..10))  # -> out, a; inputs T: tree, i: Int32
# ---------- cs: C# ----------
// Grasshopper Script Instance
#region Usings
using System;
using System.Collections;
using System.Collections.Generic;
using System.Drawing;

using Rhino;
using Rhino.Geometry;

using Grasshopper;
using Grasshopper.Kernel;
using Grasshopper.Kernel.Data;
using Grasshopper.Kernel.Types;
#endregion

public class Script_Instance : GH_ScriptInstance
{
    #region Notes
    /* 
      Members:
        RhinoDoc RhinoDocument
        GH_Document GrasshopperDocument
        IGH_Component Component
        int Iteration

      Methods (Virtual & overridable):
        Print(string text)
        Print(string format, params object[] args)
        Reflect(object obj)
        Reflect(object obj, string method_name)
    */
    #endregion

    private void RunScript(DataTree<object> T, int i, ref object a)
    {
        int count = T.BranchCount;
        if (i<0 || i> count -1)
        {
            this.Component.AddRuntimeMessage(GH_RuntimeMessageLevel.Error, "Index must be smaller than the branch count");
            return;
        }

        DataTree<object> outTree = new DataTree<object>(); 
        GH_Path path = T.Paths[i];
        List<object> branchList = T.Branch(path);

        outTree.AddRange(branchList, path);
        
        a = outTree;
        IGH_Component igc = this.Component as IGH_Component;
        igc.Message = path.ToString();
        //a = outTree;

        
    }
}
# ---------- end cs ----------

dom = ConstructDomain(DomainStart=Slider(0, range=0..1), DomainEnd=Slider(1, range=0..1))
group_2 = Group(Geometry=merge_2)
py3 = Python3Script(someData=flatten(group_2), interval=dom, transparency=Slider(0.738, range=0..1))  # -> out, graft(Colors); inputs someData: list, interval: Interval, transparency: Double
# ---------- py3: Python ----------
import Rhino as rc
import math 
def valuesToRainbow(someData, interval, transparency):
    
    """ Make a list of colors along hue spectrum,
    meaning that 0.0 = red and 0.7 = blue """

    colors = []
    # domain = rc.Geometry.Interval(0.0, 0.9)
    domain = interval
    N = len(someData)
    interval = (domain.T1 - domain.T0) / N
    for i in range(len(someData)+1):
        val = domain.T0 + (interval * i)
        hsv = rc.Display.ColorHSV(val,transparency,1.0)
        rgb = hsv.ToArgbColor()
        colors.append(rgb)
        print (rgb)
    return colors




# Make visualisation colors
Colors = valuesToRainbow(someData, interval, transparency)
# ---------- end py3 ----------
material = CreateMaterial(
    Diffuse=py3.Colors,
    Specular=RGB(255, 255, 255),
    Emission=RGB(0, 0, 0),
    Transparency=ColourSwatch(SwatchColor=RGB(92, 92, 92)),
    Shine=0)
preview = CustomPreview(Geometry=merge_2, Material=material)

simfolderpath = RemoteSender(simulation_folder)

join_4 = BrepJoin(Breps=merge_2)  # -> Breps, Closed
edges_2 = BrepEdges(Brep=join_4.Breps)  # -> Naked, Interior, NonManifold
# NB the Rhino file mus be saved in meters
# before running the analysis
previewlw = CustomPreviewLineweights(
    Geometry=edges_2.Naked,
    Shader=ColourSwatch(SwatchColor=RGB(0, 0, 0)),
    Thickness=Slider(3.5, range=0..100),
    Absolute=False)

pt = Point(<point referenced from the Rhino model>)
circle = CircleCNR(Center=pt, Normal=Vector(0, 0, 1), Radius=1)
pipeline_11 = GeometryPipeline(
    GroupByLayer=False,
    GroupByType=False,
    IncludeHidden=True,
    IncludeLocked=True,
    LayerFilter="EOC::Context buildings",
    NameFilter="*",
    SublayerFiltering=True,
    TypeFilter=1073741848)
pipeline_12 = GeometryPipeline(
    GroupByLayer=False,
    GroupByType=False,
    IncludeHidden=True,
    IncludeLocked=True,
    LayerFilter="EOC::Modelled Context",
    NameFilter="*",
    SublayerFiltering=True,
    TypeFilter=1073741848)
context_drop_m = Panel("-0.02")
Z_2 = UnitZ(Factor=context_drop_m)
merge_3 = Merge(Data1=pipeline_11, Data2=pipeline_12)
move = Move(Geometry=merge_3, Motion=Z_2)  # -> Geometry, Transform
# 1
panel = Panel("0.20")
pipeline_13 = GeometryPipeline(
    GroupByLayer=False,
    GroupByType=False,
    IncludeHidden=True,
    IncludeLocked=True,
    LayerFilter="EOC::Opaque Facade",
    NameFilter="*",
    SublayerFiltering=True,
    TypeFilter=1073741848)
pipeline_14 = GeometryPipeline(
    GroupByLayer=False,
    GroupByType=False,
    IncludeHidden=True,
    IncludeLocked=True,
    LayerFilter="EOC::Ground",
    NameFilter="*",
    SublayerFiltering=True,
    TypeFilter=1073741848)
# For material definition please refer to
# HB-Radiance Material constructors.
# For more info about the material definition look
# at the Radiance manual:
# https://floyd.lbl.gov/radiance/refer/usman2.pdf
panel_2 = Panel("0.00")
# 2
panel_3 = Panel("Shading_Material")
opaquemod = HBOpaqueModifier(name="Transparent_Facade_Material", reflect=panel, spec="0.00", rough="0.00")  # -> modifier; plug-in component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
opaquemod_2 = HBOpaqueModifier(name="Opaque_Facade_Material", reflect="0.4", spec="0.00", rough="0.00")  # -> modifier; plug-in component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
opaquemod_3 = HBOpaqueModifier(name=panel_3, reflect="0.50", spec="0.00", rough="0.00")  # -> modifier; plug-in component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
opaquemod_4 = HBOpaqueModifier(name="Ground_Material", reflect="0.35", spec="0.00", rough="0.00")  # -> modifier; plug-in component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
opaquemod_5 = HBOpaqueModifier(name="Context_Material", reflect="0.3", spec="0.00", rough=panel_2)  # -> modifier; plug-in component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
brep = Brep(pipeline_13)
# Create/import context
brep_2 = Brep(filter)
brep_3 = Brep(merge_3)
brep_4 = Brep(pipeline_14)
face = HBFace(geo=brep, rad_mod=opaquemod_2)  # -> out, faces; plug-in component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
face_2 = HBFace(geo=brep_2, rad_mod=opaquemod_3)  # -> out, faces; plug-in component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
face_3 = HBFace(geo=brep_4, rad_mod=opaquemod_4)  # -> out, faces; plug-in component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
face_4 = HBFace(geo=brep_3, rad_mod=opaquemod_5)  # -> out, faces; plug-in component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
panel_4 = Panel("""West_Office Rooms
North-West_Open Office
North_Pantry
North-East_Open Office
East_Office Rooms""")
zonesnames = RemoteSender(panel_4)

# ----
# - save the .epw file on your PC
# - right click on the component
# - "select one existing file"
# - select the file
# Run folder = Simulation folder + HB model name (HB Recipe Settings _folder_).
# From the EPWMap component set the
# toggle to true to access the online map.
# Select the EPW you need and copy
# the link in this panel
panel_5 = Panel("https://climate.onebuilding.org/WMO_Region_2_Asia/ARE_United_Arab_Emirates/ARE_DU_Dubai.Intl.AP.411940_TMYx.zip")
downloadepw = LBDownloadWeather(weather_URL=panel_5)  # -> epw_file, stat_file, ddy_file; plug-in component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

list = ValueList({"low accuracy": 0, "medium accuracy": 1, "high accuracy": 2, "very high accuracy": 3}, selected="low accuracy")
py3_2 = Python3Script(accuracy=list)  # -> out, rad_params; inputs accuracy: Int32
# ---------- py3_2: Python ----------
'''
-ab 5 -ad 5000 -lw 2e-05

ad = 
'''





if accuracy == 0:
    rad_params = '-ab 3 -ad 1024 -lw 1.00e-03'
elif accuracy == 1:
    rad_params = '-ab 4 -ad 2048 -lw 5.00e-04'
if accuracy == 2:
    rad_params = '-ab 5 -ad 4096 -lw 2.50e-04'
if accuracy == 3:
    rad_params = '-ab 6 -ad 8192 -lw 1.25e-04'
# ---------- end py3_2 ----------

# ----
# Use to change the orientation of the analyzed site.
# The Rhino standard set North as the
# positive y axis direction (0),
# change the slider to rotate with 90° steps
# and the panel to add other angles.
orientation = Slider(0, range=0..3, expression="x*90")
addition = Addition(A=orientation, B="20")
origin = Point(Point(0, 0, 0))
compass = LBCompass(north=addition, center=origin, scale="0.1")  # -> compass; plug-in component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
preview_2 = CustomPreview(Geometry=compass, Material=ColourSwatch(SwatchColor=RGB(0, 0, 0)))

simfolderpath_2 = RemoteReceiver(simfolderpath)

epwmap = LBEPWmap(epw_map=Toggle(False))  # -> report; plug-in component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

file_path = FilePath("M:\ADMINISTRATION\Facade Toolkit\7_Tools\Calculation tools\DIGITAL DESIGN\WIP\EPW\GBR_London.Gatwick.037760_IWEC.epw")
panel_6 = Panel(file_path)
results_folder = Panel(concat_2)
zonesnames_2 = RemoteReceiver(zonesnames)
results_folder_2 = Panel("C:\Users\Vishnu\simulation\Radiation_HB_Model_Baseline\annual_irradiance\results\total")  # disabled
cumulvalues = HBAnnualCumulativeValues(results=flatten(results_folder_2))  # -> report, values; disabled; plug-in component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
panel_7 = Panel("""Annual
Winter
Spring
Summer
Fall
Heating hours
Cooling hours""")
bnd = Bounds(Numbers=cumulvalues.values)  # disabled
panel_8 = Panel("10")
# 6
panel_9 = Panel("14")
legendpar = LBLegendParameters(min=panel_9, max="478", continuous_leg=Toggle(False), num_decimals="0")  # -> leg_par; plug-in component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
panel_10 = Panel(cumulvalues.values)  # disabled
data_2 = Data(cumulvalues.values)
tab_separator = Panel("\t")  # disabled
tab_separator_2 = Panel("\t")

data_3 = Data(merge_2)
bbox = BoundingBox(Content=flatten(data_3), Plane=PlaneXY(0, 0, 0), UnionBox=True)  # -> Box, Box_2
debrep_5 = DeconstructBrep(Brep=data_3)  # -> simplify(Faces), Edges, Vertices
md_slider = MDSlider(SliderMode=0, slider_value=Point(0.5, 0.5, 0.5), x_domain=Domain(0, 1), y_domain=Domain(0, 1), z_domain=Domain(0, 1))
volume = Volume(Geometry=bbox.Box)  # -> Volume, Centroid
evalsrf = EvaluateSurface(Surface=reparameterize(graft(debrep_5.Faces)), Point=md_slider)  # -> Point, simplify(Normal), UDirection, VDirection, Frame
pt_2 = Point(volume.Centroid)
vec2pt = Vector2Pt(PointA=evalsrf.Point, PointB=pt_2, Unitize=False)  # -> Vector, Length
multiplication = Multiplication(A=evalsrf.Normal, B="10")
dprod = DotProduct(VectorA=vec2pt.Vector, VectorB=evalsrf.Normal, Unitize=True)
vdis = VectorDisplay(Anchor=evalsrf.Point, Vector=multiplication)
smaller = SmallerThan(FirstNumber=dprod, SecondNumber=0)  # -> SmallerThan, OrEqualTo
sift_2 = SiftPattern(List=graft(data_3), SiftPattern=smaller.SmallerThan)  # -> Output0, Output1
flip = Flip(Surface=sift_2.Output0)  # -> Surface, Result
combine = CombineData(Input0=flip.Surface, Input1=sift_2.Output1)  # -> Result, Index
pshift_3 = ShiftPaths(Data=combine.Result, Offset=-1)

area_4 = Area(Geometry=pshift_3)  # -> Area, Centroid
alongcrv = SortAlongCurve(Points=area_4.Centroid, Curve=circle)  # -> Points, Indices
item_8 = ListItem(List=pshift_3, Index=alongcrv.Indices, Wrap=True)

data_4 = Data(item_8)

cs_2 = CSharpScript(T=item_8, i=Slider(4, range=0..10))  # -> out, a; inputs T: tree, i: Int32; same code as cs
area_5 = Area(Geometry=cs_2.a)  # -> Area, Centroid
item_9 = ListItem(List=cs_2.a, Index=Slider(4, range=0..10), Wrap=True)
# DigitalDesign Tools - Group DR
# Honeybee Radiation Analysis
# LG
# 30/09/2025
# Grasshopper version 1.0.0008
panel_11 = Panel(area_5.Area)
# Create/import geometry
brep_5 = Brep(data_4)
face_5 = HBFace(geo=brep_5, rad_mod=opaquemod)  # -> out, faces; plug-in component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
facadezones = RemoteSender(brep_5)
data_5 = Data(brep_5)

# ----
# Check on the analysis srf:
# The Normal vector must point outwards
debrep_6 = DeconstructBrep(Brep=brep_5)  # -> simplify(graft(Faces)), Edges, Vertices
srf_2 = Surface(reparameterize(debrep_6.Faces))
area_6 = Area(Geometry=srf_2)  # -> Area, Centroid
srf_cp = SurfaceClosestPoint(Point=area_6.Centroid, Surface=srf_2)  # -> Point, UVPoint, Distance
evalsrf_2 = EvaluateSurface(Surface=reparameterize(srf_2), Point=srf_cp.UVPoint)  # -> Point, simplify(Normal), UDirection, VDirection, Frame
multiplication_2 = Multiplication(A=evalsrf_2.Normal, B=Slider(0.56, range=0..10))
vdis_2 = VectorDisplay(Anchor=evalsrf_2.Point, Vector=multiplication_2)

lng = ListLength(List=data_5)
repeat = RepeatData(Data=graft(panel_4), Length=lng)  # -> simplify(Data)
series = Series(Start=0, Step=1, Count=lng)  # -> simplify(Series)
pshift_4 = ShiftPaths(Data=repeat, Offset=-1)
pshift_5 = ShiftPaths(Data=series, Offset=-1)
data_6 = Data([face_5.faces, face.faces, face_2.faces, face_3.faces, face_4.faces])
repeatzonesnames = RemoteSender(pshift_4)
concat_3 = Concatenate(FragmentA=pshift_4, FragmentB=pshift_5, JoinSeparator="_")  # -> graft(Result)
splitzonesnames = RemoteSender(concat_3)
panel_12 = Panel(pshift_4)
repeatzonesnames_2 = RemoteReceiver(repeatzonesnames)

zonesnames_3 = RemoteReceiver(zonesnames)

# ----
# Create mesh
# 3
panel_13 = Panel(".4")
genpts = LBGeneratePointGrid(geometry=graft(data_5), grid_size=panel_13, offset_dist="0.05")  # -> points, vectors, face_areas, mesh; plug-in component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

pshift_6 = ShiftPaths(Data=genpts.points, Offset=-1)
pshift_7 = ShiftPaths(Data=genpts.vectors, Offset=-1)
pshift_8 = ShiftPaths(Data=genpts.face_areas, Offset=-1)
pshift_9 = ShiftPaths(Data=genpts.mesh, Offset=-1)

sensorgrid = HBSensorGrid(name=concat_3, positions=pshift_6, directions=pshift_7, mesh=pshift_9)  # -> grid; plug-in component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

sensorpts = RemoteSender(pshift_6)
sensorarea = RemoteSender(pshift_8)

sensorarea_2 = RemoteReceiver(sensorarea)
pshift_10 = ShiftPaths(Data=sensorarea_2, Offset=-1)
ma = MassAddition(Input=pshift_10)  # -> flatten(Result), PartialResults
num = Number(expr("Round(x,2)", ma.Result))
concat_4 = Concatenate(FragmentA=num, FragmentB=" m² ")
concat_5 = Concatenate(FragmentA=zonesnames_3, FragmentC="FSA: ", FragmentB=concat_4)
legend = LegendKaramba3D(
    Colors=flatten(py3.Colors),
    Tags=concat_5,
    Scale=0.8,
    Textsize=30,
    Viewport="Iso - Mark up",
    Legend_HasHeader=False,
    Legend_Justification=2,
    Legend_Position=2)

analysismesh = RemoteSender(pshift_9)

# ----
# 4
# HB Model Definition
hb_model_name = Panel(concat)
model = HBModel(faces=flatten(data_6), name=hb_model_name)  # -> report, model; plug-in component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
assigngridsviews = HBAssignGridsAndViews(model=model.model, grids=flatten(sensorgrid))  # -> model; plug-in component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

# ----
# Visualisation
faceradianceattr = HBFaceRadianceAttributes({"Modifier": "properties.radiance.modifier.display_name", "Average Reflectance": "properties.radiance.modifier.average_reflectance", "Average Transmittance": "properties.radiance.modifier.average_transmittance", "Modifier Blk": "properties.radiance.modifier_blk.display_name", "Is Opaque": "properties.radiance.is_opaque", "Dynamic Group": "properties.radiance.dynamic_group_identifier", "State Count": "properties.radiance.state_count", "States": "properties.radiance.states"}, selected="Average Reflectance")
colorfaceattr = HBColorFaceAttributes(hb_objs=flatten(model.model), attribute=faceradianceattr)  # -> mesh, legend, wire_frame, values, colors, vis_set; plug-in component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
vizwiref = HBVisualizeWireframe(hb_objs=flatten(assigngridsviews))  # -> geo; plug-in component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

data_7 = Data(colorfaceattr.mesh)
concat_6 = Concatenate(FragmentA=simfolderpath_2, FragmentB=hb_model_name)
recipesettings = HBRecipeSettings(folder=concat_6, reload_old=False)  # -> settings; plug-in component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

# ----
# HOW TO USE (per overhang run)
# 1. Run the simulation (model name ..._D0500 etc.)
# 2. Paste its results folder ...\annual_irradiance\results\total into 'Results folder'
# 3. Copy EXPORT grid table -> Excel sheet D####, cell A4
# 4. Copy EXPORT hourly -> same sheet, cell F20
# B. GRID TABLE  (one row per sensor grid)
# n = sensors, Σa = sensor area [m²], A_glz = real glazed area of the surface [m²],
# HB check = Σ(a_i × E_i)/1000 [kWh/yr] with E_i from HB Annual Cumulative Values (Wh/m²).
# Copy into the same sheet, cell A5.
cumulvalues_2 = HBAnnualCumulativeValues(results=flatten(results_folder))  # -> report, values; plug-in component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
sensorarea_3 = RemoteReceiver(sensorarea)
multiplication_3 = Multiplication(A=cumulvalues_2.values, B=sensorarea_3)
facadezones_2 = RemoteReceiver(facadezones)
ma_2 = MassAddition(Input=multiplication_3)  # -> Result, PartialResults
wh_kwh = Panel("1000")
splitzonesnames_2 = RemoteReceiver(splitzonesnames)
ma_3 = MassAddition(Input=sensorarea_3)  # -> Result, PartialResults
lng_2 = ListLength(List=sensorarea_3)
area_7 = Area(Geometry=facadezones_2)  # -> Area, Centroid
division = Division(A=ma_2.Result, B=wh_kwh)
entwine_2 = Entwine(
    Branch00=flatten(splitzonesnames_2),
    Branch01=flatten(repeatzonesnames_2),
    Branch02=flatten(lng_2),
    Branch03=flatten(ma_3.Result),
    Branch04=flatten(area_7.Area),
    Branch05=flatten(division),
    FlattenInputs=True)
flip_2 = FlipMatrix(Data=entwine_2)
header = Panel("grid\tzone\tn sensors\tΣa [m²]\tA_glz [m²]\tHB check [kWh]")
join_5 = TextJoin(Text=flip_2, Join=tab_separator_2)
merge_4 = Merge(Data1=flatten(header), Data2=flatten(join_5))
export_grid_table = Panel(merge_4)

# ---- group: CUMULATIVE HEATMAP (native)
# CUMULATIVE INCIDENT SOLAR HEATMAP (native HB/LB)
# HB Annual Cumulative Values (Wh/m2 per sensor, all sun-up hours) / 1000 -> kWh/m2 -> LB Spatial Heatmap on the joined sensor meshes.
# One legend 0 - 500 kWh/m2 for all overhang depths (set in the panels). Bake 'mesh' + 'legend' or use the component preview for images.
# ORDER CHECK must read True: the results must come from a run with the same grid order as this script.
continuous_legend = BooleanToggle(False)
legend_min_kwh_m2 = Panel("0")
legend_max_kwh_m2 = Panel("500")
legend_segments = Panel("11")
decimals = Panel("0")
legendpar_2 = LBLegendParameters(
    min=legend_min_kwh_m2,
    max=legend_max_kwh_m2,
    seg_count=legend_segments,
    continuous_leg=continuous_legend,
    num_decimals=decimals)  # -> leg_par; plug-in component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
demesh = DeconstructMesh(Mesh=pshift_9)  # -> Vertices, Faces, Colours, Normals
lng_3 = ListLength(List=cumulvalues_2.values)
title_prefix = Panel("Cumulative incident solar (all hours) - ")
lng_4 = ListLength(List=demesh.Faces)
wh_kwh_2 = Panel("1000")
equals = Equality(FirstNumber=flatten(lng_3), SecondNumber=flatten(lng_4))  # -> Equality, Inequality
mjoin = MeshJoin(Meshes=flatten(pshift_9))
division_2 = Division(A=cumulvalues_2.values, B=wh_kwh_2)
legend_title = Panel("kWh/m2")
concat_7 = Concatenate(FragmentA=title_prefix, FragmentB=hb_model_name)
mm = MassMultiplication(Input=flatten(equals.Equality))  # -> Result, PartialResults
_1 = Panel("1")
heatmap = LBSpatialHeatmap(values=flatten(division_2), mesh=mjoin, legend_par=legendpar_2, legend_title=legend_title, global_title=concat_7)  # -> mesh, legend, title, colors, legend_par, vis_set; plug-in component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
equals_2 = Equality(FirstNumber=mm.Result, SecondNumber=_1)  # -> Equality, Inequality
order_check_results_vs_meshes = Panel(equals_2.Equality)

# ----
results_folder_3 = Panel(cumulvalues_2.values)  # disabled
analysismesh_2 = RemoteReceiver(analysismesh)
match = MatchTree(Tree=data_2, Guide=analysismesh_2)

# ---- group: Mean value for m2
sensorarea_4 = RemoteReceiver(sensorarea)  # disabled
multiplication_4 = Multiplication(A=match, B=sensorarea_4)  # disabled
pshift_11 = ShiftPaths(Data=sensorarea_4, Offset=-1)  # disabled
pshift_12 = ShiftPaths(Data=multiplication_4, Offset=-1)  # disabled
ma_4 = MassAddition(Input=pshift_11)  # -> Result, PartialResults; disabled
ma_5 = MassAddition(Input=pshift_12)  # -> Result, PartialResults; disabled
total_kwh = Panel(ma_5.Result)  # disabled
division_3 = Division(A=total_kwh, B=ma_4.Result)  # disabled
kwh_m2 = Panel(division_3)  # disabled

# ---- group: Max & Min
sort_5 = SortList(Keys=match)  # -> Keys, ValuesA
item_10 = ListItem(List=sort_5.Keys, Index=0, Wrap=True)  # -> Item1, Item
panel_14 = Panel([item_10.Item1, item_10.Item])

# ----
data_8 = Data(heatmap.legend)
data_9 = Data(heatmap.mesh)
area_m2 = Panel(ma_4.Result)  # disabled

# ----
# Radiation analysis
# 5
importepw = LBImportEPW(epw_file=downloadepw.epw_file)  # -> location, dry_bulb_temperature, dew_point_temperature, relative_humidity, wind_speed, wind_direction, direct_normal_rad, diffuse_horizontal_rad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; plug-in component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
falsestart = LBFalseStartToggle(False)

# ----
# Select the analysis period
# dbT and hte Setpoints are required only for
# heating and cooling hours definition
list_2 = ValueList({"Annual": "{0}", "Winter": "{1}", "Spring": "{2}", "Summer": "{3}", "Fall": "{4}", "Heating hours": "{5}", "Cooling hours": "{6}"}, selected="Annual")
analysis_period_definition = AnalysisPeriodDefinition(analysis_period=list_2, dry_bulb_t=importepw.dry_bulb_temperature, heating_setpoint="20", cooling_setpoint="26")  # -> hoys, heating_and_cooling_deg, graphs_borders

wea = HBWeaFromEPW(epw_file=downloadepw.epw_file, hoys=analysis_period_definition.hoys)  # -> wea; plug-in component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
annualirradiance = HBAnnualIrradiance(
    model=assigngridsviews,
    wea=wea,
    north=addition,
    radiance_par=py3_2.rad_params,
    run_settings=recipesettings,
    run=falsestart)  # -> report, results, res_direct, avg_irr, peak_irr, radiation; plug-in component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

# ----
# Turn on to visualise heating
# and cooling periods
swatch = ColourSwatch(SwatchColor=RGB(191, 191, 191))  # disabled
toggle = GroupToggle(ToggleActive=True, ToggleVisible=False)  # disabled
preview_3 = CustomPreview(Geometry=analysis_period_definition.graphs_borders, Material=swatch)  # disabled
data_10 = Data(analysis_period_definition.heating_and_cooling_deg)  # disabled

data_11 = Data(annualirradiance.results)
branch = TreeBranch(Tree=simplify(graft(panel_7)), Path=list_2, MaintainPaths=True)
concat_8 = Concatenate(FragmentA="Solar Radiation - ", FragmentB=branch)
heatmap_2 = LBSpatialHeatmap(values=match, mesh=analysismesh_2, legend_par=legendpar, legend_title="kWh/m2", global_title=concat_8)  # -> mesh, legend, title, colors, legend_par, vis_set; plug-in component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
bang = ExplodeTree(Data=heatmap_2.legend)  # -> _00000, _00001, _00002, _00003, _01000

# ---- group: Results display
results_mesh = Mesh(heatmap_2.mesh)
legend_2 = Data(bang._01000)
toggle_2 = GroupToggle(ToggleActive=True, ToggleVisible=False)  # disabled

# ----
# NOTE: this peak chain is per sensor grid, not coincident per zone.
# Use 'Zone Results (Pass 1)' (peak_kw / p99_occ_kw) instead.
data_12 = Data(data_11)  # disabled
toggle_3 = BooleanToggle(True)  # disabled
peakvalues = HBAnnualPeakValues(results=flatten(data_12), coincident=toggle_3)  # -> report, hoys, values; disabled; plug-in component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
sensorarea_5 = RemoteReceiver(sensorarea)  # disabled
multiplication_5 = Multiplication(A=sensorarea_5, B=peakvalues.values)  # disabled
facadezones_3 = RemoteReceiver(graft(facadezones))  # disabled
peakirr_w = Data(multiplication_5)  # disabled

# ---- group: FSA
area_8 = Area(Geometry=facadezones_3)  # -> Area, Centroid; disabled

# ----
division_4 = Division(A=peakirr_w, B=area_8.Area)  # disabled
w_fsa = Panel(division_4)  # disabled

# ----
# A. HOURLY  Σ(a_i × I_i(t))  PER SENSOR GRID  [W]
# I_i(t) = hourly irradiance on sensor i [W/m²] (HB Annual Results to Data)
# a_i = sensor face area [m²] (LB Generate Point Grid face_areas)
# Copy the panel (right-click > Copy Data Only) into sheet 'D0000' (or the sheet of this overhang depth), cell F20.
sensorarea_6 = RemoteReceiver(sensorarea)  # disabled
operator = Panel("*")  # disabled
operator_2 = Panel("+")  # disabled
hours_yr = Panel("8760")  # disabled
splitzonesnames_3 = RemoteReceiver(splitzonesnames)  # disabled
join_6 = TextJoin(Text=flatten(splitzonesnames_3), Join=tab_separator)  # disabled

sensorpts_2 = RemoteReceiver(sensorpts)  # disabled
data_13 = Data(data_11)  # disabled
annualtodata = HBAnnualResultsToData(results=results_folder, sel_pts=sensorpts_2, all_pts=sensorpts_2)  # -> report, data; disabled; plug-in component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
xdata = LBDeconstructData(data=annualtodata.data)  # -> header, values; disabled; plug-in component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
multiplication_6 = Multiplication(A=graft(sensorarea_6), B=xdata.values)  # disabled
path_mapper = PathMapper(multiplication_6, source="{A;B;C}(i)", target="{A;B;i}(C)")  # disabled
data_14 = Data(path_mapper)  # disabled
ma_6 = MassAddition(Input=data_14)  # -> Result, PartialResults; disabled
pshift_13 = ShiftPaths(Data=ma_6.Result, Offset=-1)  # disabled
export_hourly_σa_i_per_grid_w = Panel(pshift_13)  # disabled

arithop = LBArithmeticOperation(data_1=annualtodata.data, data_2=sensorarea_6, operator=operator)  # -> data; disabled; plug-in component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
massarithop = LBMassArithmeticOperation(data=arithop, operator=operator_2)  # -> data; disabled; plug-in component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
xdata_2 = LBDeconstructData(data=massarithop)  # -> header, values; disabled; plug-in component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
partition_2 = PartitionList(List=flatten(xdata_2.values), Size=hours_yr)  # disabled
flip_3 = FlipMatrix(Data=partition_2)  # disabled
join_7 = TextJoin(Text=flip_3, Join=tab_separator)  # disabled
merge_5 = Merge(Data1=flatten(join_6), Data2=flatten(join_7))  # disabled
export_hourly_σa_i_per_grid_w_2 = Panel(merge_5)  # disabled

# ==== cluster AnalysisPeriodDefinition
analysis_period = ClusterInput()
dry_bulb_t = ClusterInput()  # dry bulb temperature from the EPW
heating_setpoint = ClusterInput()
cooling_setpoint = ClusterInput()
hdd_cdd = LBDegreeDays(dry_bulb=dry_bulb_t, heat_base=heating_setpoint, cool_base=cooling_setpoint)  # -> hourly_heat, hourly_cool, heat_deg_days, cool_deg_days; plug-in component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
xdata = LBDeconstructData(data=hdd_cdd.hourly_heat)  # -> header, values; plug-in component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
xdata_2 = LBDeconstructData(data=hdd_cdd.hourly_cool)  # -> header, values; plug-in component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
colrange = LBColorRange(index=Slider(11, range=0..26))  # -> colors; plug-in component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
colrange_2 = LBColorRange(index=Slider(10, range=0..26))  # -> colors; plug-in component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
expression = Expression(x=xdata.values, Expression="if(x>0,1,0)")
expression_2 = Expression(x=xdata_2.values, Expression="if(x>0,1,0)")
range = Range(Domain=Domain(0, 8759), Steps=8759)
legendpar = LBLegendParameters(colors=colrange, continuous_leg=Toggle(False))  # -> leg_par; plug-in component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
legendpar_2 = LBLegendParameters(colors=colrange_2, continuous_leg=Toggle(False))  # -> leg_par; plug-in component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
python = GhPythonScript()  # -> Annual, Winter, Spring, Summer, Autumn
# ---------- python: Python ----------
# Define the number of hours in a year
hours_in_a_year = 365 * 24

# Create lists for each season
winter_hours = []
spring_hours = []
summer_hours = []
autumn_hours = []
annual_hours = []

# Assign hours to seasons
for hour in range(hours_in_a_year):
    # Calculate the day of the year (0 to 364)
    day_of_year = hour // 24

    # Add the hour to the annual list
    annual_hours.append(hour)
    
    # Assign hours to seasons based on approximate dates
    if day_of_year < 79 or day_of_year >= 355:  # Winter: Jan 1 - Mar 19, Dec 21 - Dec 31
        winter_hours.append(hour)
    elif 79 <= day_of_year < 171:  # Spring: Mar 20 - Jun 20
        spring_hours.append(hour)
    elif 171 <= day_of_year < 263:  # Summer: Jun 21 - Sep 21
        summer_hours.append(hour)
    elif 263 <= day_of_year < 355:  # Fall: Sep 22 - Dec 20
        autumn_hours.append(hour)

# Print the first few hours for each season to verify
Winter = winter_hours
Spring = spring_hours
Summer = summer_hours
Autumn = autumn_hours
Annual = annual_hours
# ---------- end python ----------
dispatch = Dispatch(List=range, DispatchPattern=expression)  # -> ListA, ListB
dispatch_2 = Dispatch(List=range, DispatchPattern=expression_2)  # -> ListA, ListB
entwine = Entwine(
    Branch00=python.Annual,
    Branch01=python.Winter,
    Branch02=python.Spring,
    Branch03=python.Summer,
    Branch04=python.Autumn,
    Branch05=dispatch.ListA,
    Branch06=dispatch_2.ListA,
    FlattenInputs=True)
branch = TreeBranch(Tree=simplify(entwine), Path=analysis_period, MaintainPaths=True)
hoys = ClusterOutput(branch)
hourlyplot = LBHourlyPlot(data=[hdd_cdd.hourly_heat, hdd_cdd.hourly_cool], x_dim="0.1", y_dim="0.4", legend_par=[legendpar_2, legendpar])  # -> report, mesh, legend, borders, labels, title, vis_set; plug-in component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
data = Data([hourlyplot.mesh, hourlyplot.legend, hourlyplot.labels, hourlyplot.title])
graphs_borders = ClusterOutput(hourlyplot.borders)
heating_and_cooling_deg = ClusterOutput(data)
