# Grasshopper definition 261026 EOC vr Incident Radiation_HB - 1.10_Context_Zones_Design Day.gh (Grasshopper 1.0.8)
# plug-ins: Karamba3D, Human, LadybugGrasshopper, MetaHopper, Telepathy

# ----
# HOW TO USE (per overhang run)
# 1. Run the simulation (model name ..._D0500 etc.)
# 2. Paste its results folder ...\annual_irradiance\results\total into 'Results folder'
# 3. Copy EXPORT grid table -> Excel sheet D####, cell A4
# 4. Copy EXPORT hourly -> same sheet, cell F20
pipeline = GeometryPipeline(
    GroupByLayer=False,
    GroupByType=False,
    IncludeHidden=True,
    IncludeLocked=True,
    LayerFilter="EOC::Glazed Facade::North",
    NameFilter="*",
    SublayerFiltering=True,
    TypeFilter=1073741848)
geo = Geometry(pipeline)
geo_2 = Geometry(geo)
area = Area(Geometry=geo_2)  # -> Area, Centroid
pdecon = Deconstruct(Point=area.Centroid)  # -> XComponent, YComponent, ZComponent
sort = SortList(Keys=pdecon.XComponent, ValuesA=geo_2)  # -> Keys, ValuesA
sift = SiftPattern(List=sort.ValuesA, SiftPattern=[0, 1, 0])  # -> Output0, Output1
Z = UnitZ(Factor="5")
crv = Curve([<curve referenced from the Rhino model> x4])
srf = Surface(reparameterize(sift.Output1))
extr = Extrude(Base=crv, Direction=Z)
graft = GraftTree(Tree=sift.Output0, IncludeEmptyLists=True, IncludeNullItems=True)
pipeline_2 = GeometryPipeline(
    GroupByLayer=False,
    GroupByType=False,
    IncludeHidden=True,
    IncludeLocked=True,
    LayerFilter="EOC::Glazed Facade::West",
    NameFilter="*",
    SublayerFiltering=True,
    TypeFilter=1073741848)
pipeline_3 = GeometryPipeline(
    GroupByLayer=False,
    GroupByType=False,
    IncludeHidden=True,
    IncludeLocked=True,
    LayerFilter="EOC::Glazed Facade::East",
    NameFilter="*",
    SublayerFiltering=True,
    TypeFilter=1073741848)
splitmul = SplitBrepMultiple(Brep=srf, Cutters=extr)  # -> reverse(Result)
partition = PartitionList(List=flatten(splitmul), Size=[1, 3, 1])
geo_3 = Geometry(pipeline_3)
geo_4 = Geometry(pipeline_2)
debrep = DeconstructBrep(Brep=partition)  # -> simplify(Faces), Edges, Vertices
entwine = Entwine(Branch00=geo_4, Branch02=geo_3, FlattenInputs=True)
join = JoinCurves(Curves=debrep.Edges, Preserve=False)
boundary = BoundarySurfaces(Edges=join)
pshift = ShiftPaths(Data=boundary, Offset=-2)
clean = CleanTree(RemoveNulls=True, RemoveInvalid=True, RemoveEmpty=True, Tree=entwine)
clean_2 = CleanTree(RemoveNulls=True, RemoveInvalid=True, RemoveEmpty=True, Tree=graft)
merge = Merge(Data1=clean, Data2=clean_2, Data3=pshift)
tstat = TreeStatistics(Tree=merge)  # -> Paths, Length, Count
item = ListItem(List=tstat.Paths, Index=Slider(1, range=0..10), Wrap=True)
split = SplitTree(Data=merge, Masks=flatten(item))  # -> graft(Positive), Negative
group = Group(Geometry=split.Negative)  # -> graft(Group)
ungroup = Ungroup(Group=group)
pshift_2 = ShiftPaths(Data=ungroup, Offset=-1)
merge_2 = Merge(Data1=split.Positive, Data2=pshift_2)
data = Data(merge_2)
bbox = BoundingBox(Content=flatten(data), Plane=PlaneXY(0, 0, 0), UnionBox=True)  # -> Box, Box_2
debrep_2 = DeconstructBrep(Brep=data)  # -> simplify(Faces), Edges, Vertices
number_slider = Slider(5, range=0..10)  # disabled
md_slider = MDSlider(SliderMode=0, slider_value=Point(0.5, 0.5, 0.5), x_domain=Domain(0, 1), y_domain=Domain(0, 1), z_domain=Domain(0, 1))
volume = Volume(Geometry=bbox.Box)  # -> Volume, Centroid
evalsrf = EvaluateSurface(Surface=reparameterize(graft(debrep_2.Faces)), Point=md_slider)  # -> Point, simplify(Normal), UDirection, VDirection, Frame
pt = Point(volume.Centroid)
cs = CSharpScript(T=merge_2, i=number_slider)  # -> out, a; inputs T: tree, i: Int32; disabled
# ---------- cs: C# ----------
// Grasshopper Script Instance
#region Usings
using System;
using System.Collections;
using System.Collections.Generic;
using System.Drawing;

using Rhino;
using Rhino.Geometry;

using Grasshopper;
using Grasshopper.Kernel;
using Grasshopper.Kernel.Data;
using Grasshopper.Kernel.Types;
#endregion

public class Script_Instance : GH_ScriptInstance
{
    #region Notes
    /* 
      Members:
        RhinoDoc RhinoDocument
        GH_Document GrasshopperDocument
        IGH_Component Component
        int Iteration

      Methods (Virtual & overridable):
        Print(string text)
        Print(string format, params object[] args)
        Reflect(object obj)
        Reflect(object obj, string method_name)
    */
    #endregion

    private void RunScript(DataTree<object> T, int i, ref object a)
    {
        int count = T.BranchCount;
        if (i<0 || i> count -1)
        {
            this.Component.AddRuntimeMessage(GH_RuntimeMessageLevel.Error, "Index must be smaller than the branch count");
            return;
        }

        DataTree<object> outTree = new DataTree<object>(); 
        GH_Path path = T.Paths[i];
        List<object> branchList = T.Branch(path);

        outTree.AddRange(branchList, path);
        
        a = outTree;
        IGH_Component igc = this.Component as IGH_Component;
        igc.Message = path.ToString();
        //a = outTree;

        
    }
}
# ---------- end cs ----------
vec2pt = Vector2Pt(PointA=evalsrf.Point, PointB=pt, Unitize=False)  # -> Vector, Length
multiplication = Multiplication(A=evalsrf.Normal, B="10")
dprod = DotProduct(VectorA=vec2pt.Vector, VectorB=evalsrf.Normal, Unitize=True)
vdis = VectorDisplay(Anchor=evalsrf.Point, Vector=multiplication)
smaller = SmallerThan(FirstNumber=dprod, SecondNumber=0)  # -> SmallerThan, OrEqualTo
sift_2 = SiftPattern(List=graft(data), SiftPattern=smaller.SmallerThan)  # -> Output0, Output1
flip = Flip(Surface=sift_2.Output0)  # -> Surface, Result
combine = CombineData(Input0=flip.Surface, Input1=sift_2.Output1)  # -> Result, Index
pshift_3 = ShiftPaths(Data=combine.Result, Offset=-1)
pt_2 = Point(<point referenced from the Rhino model>)
area_2 = Area(Geometry=pshift_3)  # -> Area, Centroid
circle = CircleCNR(Center=pt_2, Normal=Vector(0, 0, 1), Radius=1)
alongcrv = SortAlongCurve(Points=area_2.Centroid, Curve=circle)  # -> Points, Indices
item_2 = ListItem(List=pshift_3, Index=alongcrv.Indices, Wrap=True)

# ----
# NB the Rhino file mus be saved in meters
# before running the analysis
# Automatically changes input wire appearance
# Select components and click on button
# to change the input wire display
wireoptions = WireOptions({"Default": 0, "Faint": 1, "Hidden": 2}, selected="Hidden")
hidewires = HideWires(on=Button(), wire_type=wireoptions)
# ---------- hidewires: Python ----------
from Grasshopper.Kernel import GH_ParamWireDisplay
from Grasshopper.Kernel import GH_RuntimeMessageLevel 

# A dictionary of wire types 
wire_display = {'0':GH_ParamWireDisplay.default, 
                '1':GH_ParamWireDisplay.faint,
                '2':GH_ParamWireDisplay.hidden}

# Get selected components and change the wire display
if on:
    doc = ghenv.Component.OnPingDocument()
    sel_objs = doc.SelectedObjects()
    if not len(sel_objs):
        ghenv.Component.AddRuntimeMessage(GH_RuntimeMessageLevel.Warning, 'Nothing was selected')
    for sel_obj  in sel_objs:
        if hasattr(sel_obj, 'Params'):
            for p in sel_obj.Params.Input:
                p.WireDisplay = wire_display[wire_type]
        else:
                sel_obj.WireDisplay = wire_display[wire_type]
# ---------- end hidewires ----------

# ----
# DigitalDesign Tools - Group DR
# Honeybee Radiation Analysis
# LG
# 30/09/2025
# Grasshopper version 1.0.0008
# Profiler (shows script bottle-necks)
# Enable to get list of components in time order,
# double click component to centre on screen
button = Button()
profiler = Profiler(run=button)
# ---------- profiler: VB usings ----------
Imports System.IO
Imports System.Linq
Imports System.Data
Imports System.Drawing
Imports System.Reflection
Imports System.Windows.Forms
Imports System.Xml
Imports System.Xml.Linq
Imports Microsoft.VisualBasic
Imports System.Runtime.InteropServices

Imports Rhino.DocObjects
Imports Rhino.Collections
Imports GH_IO
Imports GH_IO.Serialization
# ---------- profiler: VB ----------
    add_lists()

    If (run) Then
      If (_form IsNot Nothing) Then Return

      _form = New Form()
      _form.StartPosition = FormStartPosition.CenterScreen
      _form.ShowInTaskbar = False
      _form.FormBorderStyle = FormBorderStyle.SizableToolWindow
      _form.Text = "Component List"
      AddHandler _form.FormClosing, AddressOf FormClosing

      _list = New ListView()
      _list.View = View.Details
      _list.AllowColumnReorder = False
      _list.MultiSelect = False
      _list.Columns.Add("Component", 200)
      _list.Columns.Add("Runtime", 80)
      _list.Dock = DockStyle.Fill
      AddHandler _list.ItemActivate, AddressOf ItemActivate
      _form.Controls.Add(_list)

      'Grasshopper.GUI.GH_WindowsFormUtil.CenterFormOnCursor(_form, True)
      _form.Show(Instances.DocumentEditor)
      Instances.DocumentEditor.FormShepard.RegisterForm(_form)

      If (_handler) Then Return
      AddHandler GrasshopperDocument.SolutionEnd, AddressOf DocumentSolutionEnd
    End If
# ---------- profiler: VB additional code ----------
  Private _form As Form
  Private _list As ListView
  Private _handler As Boolean = False

  Private Sub FormClosing(sender As Object, e As EventArgs)
    If (_form Is Nothing) Then Return
    RemoveHandler _form.FormClosing, AddressOf FormClosing
    RemoveHandler _list.ItemActivate, AddressOf ItemActivate

    _form = Nothing
    _list = Nothing
  End Sub
  Private Sub ItemActivate(sender As Object, e As EventArgs)
    Try
      Dim item As ListViewItem = _list.SelectedItems(0)
      Dim target As RectangleF = TryCast(item.Tag, IGH_DocumentObject).Attributes.Bounds
      Dim view As New Grasshopper.GUI.Canvas.GH_NamedView(Instances.ActiveCanvas.Viewport.ScreenPort, target)
      view.SetToViewport(Instances.ActiveCanvas, 350)
    Catch
    End Try
  End Sub

  Private Sub DocumentSolutionEnd(sender As Object, e As GH_SolutionEventArgs)
    If (_form Is Nothing) Then Return
    _list.Items.Clear()

    Dim doc As GH_Document = e.Document
    If (doc Is Nothing) Then Return
    If (doc.ObjectCount = 0) Then Return

    Dim times As Int64()
    Dim objects As IGH_DocumentObject()
    ReDim times(doc.ObjectCount - 1)
    ReDim objects(doc.ObjectCount - 1)
    For i As Int32 = 0 To doc.ObjectCount - 1
      Dim obj As IGH_ActiveObject = TryCast(doc.Objects(i), IGH_ActiveObject)
      If (obj Is Nothing) Then
        times(i) = 0
        objects(i) = doc.Objects(i)
        Continue For
      End If

      times(i) = obj.ProcessorTime.Ticks
      objects(i) = obj
    Next
    Array.Sort(times, objects)

    For i As Int32 = doc.ObjectCount - 1 To 0 Step -1
      If (times(i) < TimeSpan.TicksPerMillisecond) Then Continue For
      Dim item As New ListViewItem(objects(i).Name)
      item.Tag = objects(i)
      item.SubItems.Add(String.Format("{0:0} ms", New TimeSpan(times(i)).TotalMilliseconds))
      _list.Items.Add(item)
    Next
    _list.Invalidate()
  End Sub

  Public Sub add_lists()
    If (Component.Params.Input(0).SourceCount = 0) Then
      Component.Attributes.PerformLayout()
      Dim grpList As Grasshopper.Kernel.Special.GH_ButtonObject
      grpList = New Grasshopper.Kernel.Special.GH_ButtonObject
      grpList.CreateAttributes()
      grpList.Attributes.Pivot = New System.Drawing.PointF(Component.Attributes.DocObject.Attributes.Bounds.Left - 1.2 * grpList.Attributes.Bounds.Width, Component.Attributes.DocObject.Attributes.Bounds.Top + 3)

      GrasshopperDocument.AddObject(grpList, False)
      Component.Params.Input(0).AddSource(grpList)
      Component.Params.OnParametersChanged()
      grpList.ExpireSolution(True)
    End If
  End Sub
# ---------- end profiler ----------

# ----
# Unit Conversion Factor
# mm to Rhino units
c_script = CSharpScript()  # -> factor
# ---------- c_script: C# ----------
    double f = 0;
    string units = Rhino.RhinoDoc.ActiveDoc.GetUnitSystemName(true, true, true, true);
    if (units == "mm") f = 1;
    else if (units == "m") f = 1000;
    else f = 1;

    factor = f;
# ---------- end c_script ----------
panel = Panel(c_script)

# ----
# Automatically changes group colours based on tag
# Use to change the colour of groups based on
# the group name (changed by right-clicking the
# group and typing a name in the box)
group_button = Button()
panel_button = Button()
selected_only = BooleanToggle(True)
panel_2 = Panel("""Input
Output
WIP""")
colour_swatch = ColourSwatch(SwatchColor=RGBA(255, 255, 255, 100))
merge_3 = Merge(
    Data1=ColourSwatch(SwatchColor=RGBA(0, 255, 64, 100)),
    Data2=ColourSwatch(SwatchColor=RGBA(0, 64, 255, 100)),
    Data3=ColourSwatch(SwatchColor=RGBA(255, 0, 0, 100)))
group_color = SliderGroupColor(run=group_button, groupNames=panel_2, colors=merge_3, defaultColor=colour_swatch, selectedOnly=selected_only)  # inputs run: Boolean, groupNames: list of String, colors: list of Color, defaultColor: Color, selectedOnly: Boolean
# ---------- group_color: C# usings ----------
using System.Drawing;
using Grasshopper.Kernel.Special;
# ---------- group_color: C# ----------
    // Created by Timo Harboe Nielsen - Bjarke Ingels Group.

    if(!run){
      return;
    }
    GH_Document doc = owner.OnPingDocument();
    if (selectedOnly)
    {
      foreach (var dobj in doc.SelectedObjects())
      {
        GH_Group _group = dobj as GH_Group;
        if( _group == null){
          continue;
        }
        for(int i = 0; i < Math.Min(groupNames.Count, colors.Count); i++){
          string groupName = _group.NickName.ToString();
          string compareName = groupNames[i];
          if(groupName.IndexOf(compareName, StringComparison.OrdinalIgnoreCase) >= 0)
          {
            _group.Colour = colors[i];
            break;
          }
          else if(groupName == "")
          {
            _group.Colour = defaultColor;
          }
        }
      }
    }
    else
    {
      foreach (var dobj in doc.Objects)
      {
        GH_Group _group = dobj as GH_Group;
        if( _group == null){
          continue;
        }
        for(int i = 0; i < Math.Min(groupNames.Count, colors.Count); i++){
          string groupName = _group.NickName.ToString();
          string compareName = groupNames[i];
          if(groupName.IndexOf(compareName, StringComparison.OrdinalIgnoreCase) >= 0){
            _group.Colour = colors[i];
            break;
          }
          else if(groupName == "")
          {
            _group.Colour = defaultColor;
          }
        }
      }
    }
# ---------- end group_color ----------
group_color_2 = SliderGroupColor(run=panel_button, panelNames=panel_2, colors=merge_3, defaultColor=colour_swatch, selectedOnly=selected_only)  # inputs run: Boolean, panelNames: list of String, colors: list of Color, defaultColor: Color, selectedOnly: Boolean
# ---------- group_color_2: C# ----------
    // Created by Timo Harboe Nielsen - Bjarke Ingels Group.

    if(!run){
      return;
    }
    GH_Document doc = owner.OnPingDocument();
    if (selectedOnly)
    {
      foreach (var dobj in doc.SelectedObjects())
      {
        GH_Panel _group = dobj as GH_Panel;
        if( _group == null){
          continue;
        }
        for(int i = 0; i < Math.Min(panelNames.Count, colors.Count); i++){
          string groupName = _group.NickName.ToString();
          string compareName = panelNames[i];
          if(groupName.IndexOf(compareName, StringComparison.OrdinalIgnoreCase) >= 0)
          {
            _group.Properties.Colour = Color.FromArgb(colors[i].R, colors[i].G, colors[i].B);
            break;
          }
          else if(groupName == "")
          {
            _group.Properties.Colour = Color.FromArgb(defaultColor.R, defaultColor.G, defaultColor.B);
          }
        }
      }
    }
    else
    {
      foreach (var dobj in doc.Objects)
      {
        GH_Panel _group = dobj as GH_Panel;
        if( _group == null){
          continue;
        }
        for(int i = 0; i < Math.Min(panelNames.Count, colors.Count); i++){
          string groupName = _group.NickName.ToString();
          string compareName = panelNames[i];
          if(groupName.IndexOf(compareName, StringComparison.OrdinalIgnoreCase) >= 0){
            _group.Properties.Colour = Color.FromArgb(colors[i].R, colors[i].G, colors[i].B);
            break;
          }
          else if(groupName == "")
          {
            _group.Properties.Colour = Color.FromArgb(defaultColor.R, defaultColor.G, defaultColor.B);
          }
        }
      }
    }
# ---------- end group_color_2 ----------

# ----
# Style Guide:
# Hue:
# Sat: 100 (except white)
# Val: 100
# A: 100
data_2 = Data(0)

# ---- group: General
# Text Size: 25 (medium), 12 (small), 50 (large), 100 (extra large)
# Font: Microsoft Sans Serif
data_3 = Data(0)

# ---- group: 45
# 45
data_4 = Data(0)

# ---- group: 90
# 90
data_5 = Data(0)

# ---- group: 135
# 135
data_6 = Data(0)

# ---- group: Input
data_7 = Data(0)

# ---- group: 180
# 180
data_8 = Data(0)

# ---- group: 225
# 225
data_9 = Data(0)

# ---- group: Output
data_10 = Data(0)

# ---- group: 270
# 270
data_11 = Data(0)

# ---- group: 315
# 315
data_12 = Data(0)

# ---- group: 0
# 0
data_13 = Data(0)

# ---- group: WIP
data_14 = Data(0)

# ----
pipeline_4 = GeometryPipeline(
    GroupByLayer=False,
    GroupByType=False,
    IncludeHidden=True,
    IncludeLocked=True,
    LayerFilter="EOC::Context buildings",
    NameFilter="*",
    SublayerFiltering=True,
    TypeFilter=1073741848)
pipeline_5 = GeometryPipeline(
    GroupByLayer=False,
    GroupByType=False,
    IncludeHidden=True,
    IncludeLocked=True,
    LayerFilter="EOC::Modelled Context",
    NameFilter="*",
    SublayerFiltering=True,
    TypeFilter=1073741848)
context_drop_m = Panel("-0.02")
Z_2 = UnitZ(Factor=context_drop_m)
merge_4 = Merge(Data1=pipeline_4, Data2=pipeline_5)
move = Move(Geometry=merge_4, Motion=Z_2)  # -> Geometry, Transform

# ----
# 1
# Create/import geometry
number_slider_2 = Slider(4, range=0..10)
cs_2 = CSharpScript(T=item_2, i=Slider(0, range=0..10))  # -> out, a; inputs T: tree, i: Int32; same code as cs
item_3 = ListItem(List=cs_2.a, Index=number_slider_2, Wrap=True)

pipeline_6 = GeometryPipeline(
    GroupByLayer=False,
    GroupByType=False,
    IncludeHidden=True,
    IncludeLocked=True,
    LayerFilter="EOC::Skylight",
    NameFilter="*",
    SublayerFiltering=True,
    TypeFilter=1073741848)
data_15 = Data(item_2)
pipeline_7 = GeometryPipeline(
    GroupByLayer=False,
    GroupByType=False,
    IncludeHidden=True,
    IncludeLocked=True,
    LayerFilter="EOC::Opaque Facade",
    NameFilter="*",
    SublayerFiltering=True,
    TypeFilter=1073741848)
pipeline_8 = GeometryPipeline(
    GroupByLayer=False,
    GroupByType=False,
    IncludeHidden=True,
    IncludeLocked=True,
    LayerFilter="EOC::Ground",
    NameFilter="*",
    SublayerFiltering=True,
    TypeFilter=1073741848)
# For material definition please refer to
# HB-Radiance Material constructors.
# For more info about the material definition look
# at the Radiance manual:
# https://floyd.lbl.gov/radiance/refer/usman2.pdf
panel_3 = Panel("0.00")
skylight_path_in = Panel("{0}")
# 2
skylight_path_out_after_facade_zones = Panel("{0;3;0;0}")
opaquemod = HBOpaqueModifier(name="Transparent_Roof_Material", reflect="0.20", spec="0.00", rough="0.00")  # -> modifier; plug-in component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
opaquemod_2 = HBOpaqueModifier(name="Transparent_Facade_Material", reflect="0.20", spec="0.00", rough="0.00")  # -> modifier; plug-in component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
opaquemod_3 = HBOpaqueModifier(name="Opaque_Facade_Material", reflect="0.4", spec="0.00", rough="0.00")  # -> modifier; plug-in component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
opaquemod_4 = HBOpaqueModifier(name="Shading_Material", reflect="0.50", spec="0.00", rough="0.00")  # -> modifier; plug-in component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
opaquemod_5 = HBOpaqueModifier(name="Ground_Material", reflect="0.35", spec="0.00", rough="0.00")  # -> modifier; plug-in component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
opaquemod_6 = HBOpaqueModifier(name="Context_Material", reflect="0.3", spec="0.00", rough=panel_3)  # -> modifier; plug-in component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
brep = Brep(pipeline_6)
brep_2 = Brep(merge_4)
# Create/import context
brep_3 = Brep(<brep referenced from the Rhino model>)
brep_4 = Brep(data_15)
brep_5 = Brep(pipeline_7)
brep_6 = Brep(pipeline_8)
face = HBFace(geo=brep_5, rad_mod=opaquemod_3)  # -> out, faces; plug-in component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
face_2 = HBFace(geo=brep, rad_mod=opaquemod)  # -> out, faces; plug-in component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
face_3 = HBFace(geo=brep_6, rad_mod=opaquemod_5)  # -> out, faces; plug-in component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
face_4 = HBFace(geo=brep_4, rad_mod=opaquemod_2)  # -> out, faces; plug-in component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
face_5 = HBFace(geo=brep_2, rad_mod=opaquemod_6)  # -> out, faces; plug-in component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
replace = ReplacePaths(Data=brep, Search=skylight_path_in, Replace=skylight_path_out_after_facade_zones)
merge_5 = Merge(Data1=brep_4, Data2=replace)

# ----
# Create mesh
# 3
facade_skylight_grids = Brep(merge_5)
panel_4 = Panel("""West_Office Rooms
North-West_Open Office
North_Pantry
North-East_Open Office
East_Office Rooms
Skylight""")
facade_sklightzones = RemoteSender(facade_skylight_grids)
data_16 = Data(facade_skylight_grids)
lng = ListLength(List=data_16)
genpts = LBGeneratePointGrid(geometry=graft(data_16), grid_size=".4", offset_dist="0.05")  # -> points, vectors, face_areas, mesh; plug-in component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
repeat = RepeatData(Data=graft(panel_4), Length=lng)  # -> simplify(Data)
series = Series(Start=0, Step=1, Count=lng)  # -> simplify(Series)
zonesnames = RemoteSender(panel_4)
pshift_4 = ShiftPaths(Data=repeat, Offset=-1)
pshift_5 = ShiftPaths(Data=series, Offset=-1)
pshift_6 = ShiftPaths(Data=genpts.points, Offset=-1)
pshift_7 = ShiftPaths(Data=genpts.vectors, Offset=-1)
pshift_8 = ShiftPaths(Data=genpts.face_areas, Offset=-1)
pshift_9 = ShiftPaths(Data=genpts.mesh, Offset=-1)
repeatzonesnames = RemoteSender(pshift_4)
concat = Concatenate(FragmentA=pshift_4, FragmentB=pshift_5, JoinSeparator="_")  # -> graft(Result)
panel_5 = Panel(pshift_4)
sensorgrid = HBSensorGrid(name=concat, positions=pshift_6, directions=pshift_7, mesh=pshift_9)  # -> grid; plug-in component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
analysismesh = RemoteSender(pshift_9)
sensorpts = RemoteSender(pshift_6)
sensorarea = RemoteSender(pshift_8)
splitzonesnames = RemoteSender(concat)

start_hour = Panel("8")
end_hour = Panel("17")
analysisperiod = LBAnalysisPeriod(start_month=1, start_day=1, start_hour=start_hour, end_hour=end_hour)  # -> period, hoys, dates; plug-in component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
_24 = Panel("24")
division = Division(A=analysisperiod.hoys, B=_24)
jan_1_2026_thu_3 = Panel("3")
round = Round(Number=division)  # -> Nearest, Floor, Ceiling
addition = Addition(A=round.Floor, B=jan_1_2026_thu_3)
_7 = Panel("7")
mon_fri_0_4 = Panel("5")
mod = Modulus(A=addition, B=_7)
smaller_2 = SmallerThan(FirstNumber=mod, SecondNumber=mon_fri_0_4)  # -> SmallerThan, OrEqualTo
cull = CullPattern(List=analysisperiod.hoys, CullPattern=smaller_2.SmallerThan)

dom = ConstructDomain(DomainStart=Slider(0.194, range=0..1), DomainEnd=Slider(1, range=0..1))
group_2 = Group(Geometry=merge_2)
py3 = Python3Script(someData=flatten(group_2), interval=dom, transparency=Slider(0.738, range=0..1))  # -> out, graft(Colors); inputs someData: list, interval: Interval, transparency: Double
# ---------- py3: Python ----------
import Rhino as rc
import math 
def valuesToRainbow(someData, interval, transparency):
    
    """ Make a list of colors along hue spectrum,
    meaning that 0.0 = red and 0.7 = blue """

    colors = []
    # domain = rc.Geometry.Interval(0.0, 0.9)
    domain = interval
    N = len(someData)
    interval = (domain.T1 - domain.T0) / N
    for i in range(len(someData)+1):
        val = domain.T0 + (interval * i)
        hsv = rc.Display.ColorHSV(val,transparency,1.0)
        rgb = hsv.ToArgbColor()
        colors.append(rgb)
        print (rgb)
    return colors




# Make visualisation colors
Colors = valuesToRainbow(someData, interval, transparency)
# ---------- end py3 ----------
swatch = ColourSwatch(SwatchColor=RGB(102, 102, 102))
material = CreateMaterial(Diffuse=py3.Colors, Specular=RGB(255, 255, 255), Emission=RGB(0, 0, 0), Transparency=0, Shine=0)
preview = CustomPreview(Geometry=merge_2, Material=material)

join_2 = BrepJoin(Breps=merge_2)  # -> Breps, Closed
edges = BrepEdges(Brep=join_2.Breps)  # -> Naked, Interior, NonManifold
previewlw = CustomPreviewLineweights(Geometry=edges.Naked, Shader=ColourSwatch(SwatchColor=RGB(0, 0, 0)), Thickness=Slider(3.5, range=0..100), Absolute=False)

area_3 = Area(Geometry=item_2)  # -> Area, Centroid
ma = MassAddition(Input=area_3.Area)  # -> Result, PartialResults
panel_6 = Panel(ma.Result)
pdecon_2 = Deconstruct(Point=py3.Colors)  # -> XComponent, YComponent, ZComponent
frgb = ColourRGBF(Alpha=1, Red=pdecon_2.XComponent, Green=pdecon_2.YComponent, Blue=pdecon_2.ZComponent)

sensorarea_2 = RemoteReceiver(sensorarea)
pshift_10 = ShiftPaths(Data=sensorarea_2, Offset=-1)
ma_2 = MassAddition(Input=pshift_10)  # -> flatten(Result), PartialResults
zonesnames_2 = RemoteReceiver(zonesnames)
num = Number(expr("Round(x,2)", flatten(ma.Result)))
concat_2 = Concatenate(FragmentA=num, FragmentB=" m² ")
concat_3 = Concatenate(FragmentA=zonesnames_2, FragmentC="FSA: ", FragmentB=concat_2)
legend = LegendKaramba3D(
    Colors=flatten(frgb),
    Tags=concat_3,
    Scale=0.8,
    Textsize=30,
    Viewport="Iso - Mark up",
    Legend_HasHeader=False,
    Legend_Justification=2,
    Legend_Position=2)

# ----
# - save the .epw file on your PC
# - right click on the component
# - "select one existing file"
# - select the file
# Run folder = Simulation folder + HB model name (HB Recipe Settings _folder_).
# From the EPWMap component set the
# toggle to true to access the online map.
# Select the EPW you need and copy
# the link in this panel
panel_7 = Panel("https://climate.onebuilding.org/WMO_Region_2_Asia/ARE_United_Arab_Emirates/ARE_DU_Dubai.Intl.AP.411940_TMYx.zip")
downloadepw = LBDownloadWeather(weather_URL=panel_7)  # -> epw_file, stat_file, ddy_file; plug-in component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

list = ValueList({"low accuracy": 0, "medium accuracy": 1, "high accuracy": 2, "very high accuracy": 3}, selected="low accuracy")
py3_2 = Python3Script(accuracy=list)  # -> out, rad_params; inputs accuracy: Int32
# ---------- py3_2: Python ----------
'''
-ab 5 -ad 5000 -lw 2e-05

ad = 
'''





if accuracy == 0:
    rad_params = '-ab 3 -ad 1024 -lw 1.00e-03'
elif accuracy == 1:
    rad_params = '-ab 4 -ad 2048 -lw 5.00e-04'
if accuracy == 2:
    rad_params = '-ab 5 -ad 4096 -lw 2.50e-04'
if accuracy == 3:
    rad_params = '-ab 6 -ad 8192 -lw 1.25e-04'
# ---------- end py3_2 ----------

# ----
# Use to change the orientation of the analyzed site.
# The Rhino standard set North as the
# positive y axis direction (0),
# change the slider to rotate with 90° steps
# and the panel to add other angles.
orientation = Slider(0, range=0..3, expression="x*90")
addition_2 = Addition(A=orientation, B="20")
origin = Point(Point(0, 0, 0))
compass = LBCompass(north=addition_2, center=origin, scale="0.1")  # -> compass; plug-in component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
preview_2 = CustomPreview(Geometry=compass, Material=ColourSwatch(SwatchColor=RGB(0, 0, 0)))

epwmap = LBEPWmap(epw_map=Toggle(False))  # -> report; plug-in component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

north = RemoteSender(addition_2)
tauclearsky = HBWeaFromTauClearSky(stat_file=downloadepw.stat_file, timestep="1")  # -> wea; plug-in component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
file_path = FilePath("M:\ADMINISTRATION\Facade Toolkit\7_Tools\Calculation tools\DIGITAL DESIGN\WIP\EPW\GBR_London.Gatwick.037760_IWEC.epw")
panel_8 = Panel(file_path)
north_2 = RemoteReceiver(north)

# ---- group: OVERHANG DEPTH SWITCH
# OVERHANG DEPTH SWITCH
# Pick the depth in 'Overhang D'. It selects the Roof + Context Wall layers of that depth (Rhino layers EOC::D###::...),
# names the HB model Radiation_HB_Model_D#### (own simulation folder) and points 'Results folder' to it.
sky = ValueList({"TMYx (typical year, annual)": 0, "Design day (ASHRAE clear sky, tau from STAT)": 1}, selected="TMYx (typical year, annual)")
overhang_d = ValueList({"D0000  (D00)": 0, "D0500  (D500)": 1, "D0750  (D750)": 2, "D1000  (D1000)": 3, "D1250  (D1250)": 4, "D1500  (D1500)": 5, "D1130  (Architect's option)": 6}, selected="D1250  (D1250)")
sky_labels = Panel("""TMYx
DesignDay""")
pipeline_9 = GeometryPipeline(
    GroupByLayer=False,
    GroupByType=False,
    IncludeHidden=True,
    IncludeLocked=True,
    LayerFilter="EOC::D00::Roof",
    NameFilter="*",
    SublayerFiltering=True,
    TypeFilter=1073741848)
pipeline_10 = GeometryPipeline(
    GroupByLayer=False,
    GroupByType=False,
    IncludeHidden=True,
    IncludeLocked=True,
    LayerFilter="EOC::D500::Roof",
    NameFilter="*",
    SublayerFiltering=True,
    TypeFilter=1073741848)
pipeline_11 = GeometryPipeline(
    GroupByLayer=False,
    GroupByType=False,
    IncludeHidden=True,
    IncludeLocked=True,
    LayerFilter="EOC::D750::Roof",
    NameFilter="*",
    SublayerFiltering=True,
    TypeFilter=1073741848)
pipeline_12 = GeometryPipeline(
    GroupByLayer=False,
    GroupByType=False,
    IncludeHidden=True,
    IncludeLocked=True,
    LayerFilter="EOC::D1000::Roof",
    NameFilter="*",
    SublayerFiltering=True,
    TypeFilter=1073741848)
pipeline_13 = GeometryPipeline(
    GroupByLayer=False,
    GroupByType=False,
    IncludeHidden=True,
    IncludeLocked=True,
    LayerFilter="EOC::D1250::Roof",
    NameFilter="*",
    SublayerFiltering=True,
    TypeFilter=1073741848)
pipeline_14 = GeometryPipeline(
    GroupByLayer=False,
    GroupByType=False,
    IncludeHidden=True,
    IncludeLocked=True,
    LayerFilter="EOC::D1500::Roof",
    NameFilter="*",
    SublayerFiltering=True,
    TypeFilter=1073741848)
item_4 = ListItem(List=sky_labels, Index=sky, Wrap=True)
sep = Panel("_")
d1000 = RemoteSender(pipeline_12)
d1250 = RemoteSender(pipeline_13)
d1500 = RemoteSender(pipeline_14)
d500 = RemoteSender(pipeline_10)
d750 = RemoteSender(pipeline_11)
d00 = RemoteSender(pipeline_9)
filter = StreamFilter(
    Gate=overhang_d,
    Stream0=pipeline_9,
    Stream1=pipeline_10,
    Stream2=pipeline_11,
    Stream3=pipeline_12,
    Stream4=pipeline_13,
    Stream5=pipeline_14)

model_name_prefix = Panel("Radiation_HB_Model_")
run_labels = Panel("""D0000
D0500
D0750
D1000
D1250
D1500
D1130""")
item_5 = ListItem(List=run_labels, Index=overhang_d, Wrap=True)
concat_4 = Concatenate(FragmentA=model_name_prefix, FragmentB=item_5, FragmentC=sep, FragmentD=item_4)
run_label_excel_sheet = Panel(item_5)
simulation_folder = Panel("C:\Users\Vishnu\simulation\DFF-context-zones-261019\")
results_sub_folder = Panel("\annual_irradiance\results\total")
concat_5 = Concatenate(FragmentA=simulation_folder, FragmentB=concat_4, FragmentC=results_sub_folder)

# ----
modelname = RemoteSender(concat_4)

# ---- group: OVERHANG DEPTH SWITCH (continued)
simfolderpath = RemoteSender(simulation_folder)

# ----
brep_7 = Brep(filter)
face_6 = HBFace(geo=brep_7, rad_mod=opaquemod_4)  # -> out, faces; plug-in component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

# ----
# Check on the analysis srf:
# The Normal vector must point outwards
debrep_3 = DeconstructBrep(Brep=brep_7)  # -> simplify(graft(Faces)), Edges, Vertices
srf_2 = Surface(reparameterize(debrep_3.Faces))
area_4 = Area(Geometry=srf_2)  # -> Area, Centroid
srf_cp = SurfaceClosestPoint(Point=area_4.Centroid, Surface=srf_2)  # -> Point, UVPoint, Distance
evalsrf_2 = EvaluateSurface(Surface=reparameterize(srf_2), Point=srf_cp.UVPoint)  # -> Point, simplify(Normal), UDirection, VDirection, Frame
multiplication_2 = Multiplication(A=evalsrf_2.Normal, B=Slider(0.56, range=0..10))
vdis_2 = VectorDisplay(Anchor=evalsrf_2.Point, Vector=multiplication_2)

data_17 = Data([face_4.faces, face.faces, face_6.faces, face_3.faces, face_5.faces, face_2.faces])

# ----
# 4
# HB Model Definition
modelname_2 = RemoteReceiver(modelname)
hb_model_name = Panel(modelname_2)
model = HBModel(faces=flatten(data_17), name=hb_model_name)  # -> report, model; plug-in component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

# ----
# Visualisation
faceradianceattr = HBFaceRadianceAttributes({"Modifier": "properties.radiance.modifier.display_name", "Average Reflectance": "properties.radiance.modifier.average_reflectance", "Average Transmittance": "properties.radiance.modifier.average_transmittance", "Modifier Blk": "properties.radiance.modifier_blk.display_name", "Is Opaque": "properties.radiance.is_opaque", "Dynamic Group": "properties.radiance.dynamic_group_identifier", "State Count": "properties.radiance.state_count", "States": "properties.radiance.states"}, selected="Average Reflectance")
assigngridsviews = HBAssignGridsAndViews(model=model.model, grids=flatten(sensorgrid))  # -> model; plug-in component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
colorfaceattr = HBColorFaceAttributes(hb_objs=flatten(model.model), attribute=faceradianceattr)  # -> mesh, legend, wire_frame, values, colors, vis_set; plug-in component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
vizwiref = HBVisualizeWireframe(hb_objs=flatten(assigngridsviews))  # -> geo; plug-in component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
data_18 = Data(colorfaceattr.mesh)

simfolderpath_2 = RemoteReceiver(simfolderpath)
concat_6 = Concatenate(FragmentA=simfolderpath_2, FragmentB=hb_model_name)
recipesettings = HBRecipeSettings(folder=concat_6, reload_old=False)  # -> settings; plug-in component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

# ----
# B. GRID TABLE  (one row per sensor grid)
# n = sensors, Σa = sensor area [m²], A_glz = real glazed area of the surface [m²],
# HB check = Σ(a_i × E_i)/1000 [kWh/yr] with E_i from HB Annual Cumulative Values (Wh/m²).
# Copy into the same sheet, cell A5.
results_folder = Panel(concat_5)
cumulvalues = HBAnnualCumulativeValues(results=flatten(results_folder))  # -> report, values; plug-in component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
sensorarea_3 = RemoteReceiver(sensorarea)
multiplication_3 = Multiplication(A=cumulvalues.values, B=sensorarea_3)
facade_sklightzones_2 = RemoteReceiver(facade_sklightzones)
ma_3 = MassAddition(Input=multiplication_3)  # -> Result, PartialResults
wh_kwh = Panel("1000")
repeatzonesnames_2 = RemoteReceiver(repeatzonesnames)
splitzonesnames_2 = RemoteReceiver(splitzonesnames)
ma_4 = MassAddition(Input=sensorarea_3)  # -> Result, PartialResults
lng_2 = ListLength(List=sensorarea_3)
area_5 = Area(Geometry=facade_sklightzones_2)  # -> Area, Centroid
division_2 = Division(A=ma_3.Result, B=wh_kwh)
entwine_2 = Entwine(
    Branch00=flatten(splitzonesnames_2),
    Branch01=flatten(repeatzonesnames_2),
    Branch02=flatten(lng_2),
    Branch03=flatten(ma_4.Result),
    Branch04=flatten(area_5.Area),
    Branch05=flatten(division_2),
    FlattenInputs=True)
flip_2 = FlipMatrix(Data=entwine_2)
tab_separator = Panel("\t")
header = Panel("grid\tzone\tn sensors\tΣa [m²]\tA_glz [m²]\tHB check [kWh]")
join_3 = TextJoin(Text=flip_2, Join=tab_separator)
merge_6 = Merge(Data1=flatten(header), Data2=flatten(join_3))
export_grid_table = Panel(merge_6)

# ---- group: CUMULATIVE HEATMAP (native)
# CUMULATIVE INCIDENT SOLAR HEATMAP (native HB/LB)
# HB Annual Cumulative Values (Wh/m2 per sensor, all sun-up hours) / 1000 -> kWh/m2 -> LB Spatial Heatmap on the joined sensor meshes.
# One legend 0 - 500 kWh/m2 for all overhang depths (set in the panels). Bake 'mesh' + 'legend' or use the component preview for images.
# ORDER CHECK must read True: the results must come from a run with the same grid order as this script.
continuous_legend = BooleanToggle(False)
legend_min_kwh_m2 = Panel("0")
legend_max_kwh_m2 = Panel("500")
legend_segments = Panel("11")
decimals = Panel("0")
legendpar = LBLegendParameters(
    min=legend_min_kwh_m2,
    max=legend_max_kwh_m2,
    seg_count=legend_segments,
    continuous_leg=continuous_legend,
    num_decimals=decimals)  # -> leg_par; plug-in component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
analysismesh_2 = RemoteReceiver(analysismesh)
title_prefix = Panel("Cumulative incident solar (all hours) - ")
modelname_3 = RemoteReceiver(modelname)
wh_kwh_2 = Panel("1000")
demesh = DeconstructMesh(Mesh=analysismesh_2)  # -> Vertices, Faces, Colours, Normals
lng_3 = ListLength(List=cumulvalues.values)
mjoin = MeshJoin(Meshes=flatten(analysismesh_2))
division_3 = Division(A=cumulvalues.values, B=wh_kwh_2)
lng_4 = ListLength(List=demesh.Faces)
legend_title = Panel("kWh/m2")
concat_7 = Concatenate(FragmentA=title_prefix, FragmentB=modelname_3)
heatmap = LBSpatialHeatmap(values=flatten(division_3), mesh=mjoin, legend_par=legendpar, legend_title=legend_title, global_title=concat_7)  # -> mesh, legend, title, colors, legend_par, vis_set; plug-in component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
equals = Equality(FirstNumber=flatten(lng_3), SecondNumber=flatten(lng_4))  # -> Equality, Inequality
mm = MassMultiplication(Input=flatten(equals.Equality))  # -> Result, PartialResults
_1 = Panel("1")
data_19 = Data(heatmap.mesh)
data_20 = Data(heatmap.legend)
equals_2 = Equality(FirstNumber=mm.Result, SecondNumber=_1)  # -> Equality, Inequality
order_check_results_vs_meshes = Panel(equals_2.Equality)

# ----
# SUN PATH + SKY RADIATION + SHADING MASK  -  North-West Open Office (worst-case zone)
# Sky dome: total radiation per sky patch over OCCUPIED hours (08-18, Mon-Fri, kWh/m2). Sun path: sun positions coloured by direct normal radiation (W/m2).
# Grey: sky not seen by the glass = orientation mask (behind the facade) + overhang/context mask, seen from the selected point on the NW Open Office glass.
# Reference: mask point at sill = whole pane shaded when the sun is masked (Olgyay; Szokolay; CIBSE TM37). Diagram drawn at 'Diagram origin' (move it freely).
diagram_mask_point_height = ValueList({"Sill  (z 0.05 m) - full pane shaded": 0.05, "Centre  (z 2.34 m) - half pane": 2.335, "Head  (z 4.62 m) - shading starts": 4.62}, selected="Centre  (z 2.34 m) - half pane")
diagram_context = ValueList({"No context": 0, "Modelled + CADMapper context": 1}, selected="Modelled + CADMapper context")
diagram_overhang_d = ValueList({"D0000  (no overhang)": 0, "D0500": 1, "D0750": 2, "D1000": 3, "D1130  (Architect's option)": 6, "D1250": 4, "D1500": 5}, selected="D1500")
projection = Panel("Stereographic")
diagram_scale_0_2_20_m_radius = Panel("0.2")
diascale = RemoteSender(diagram_scale_0_2_20_m_radius)
proj = RemoteSender(projection)
diagram_origin_move_me = Point(Point(0, 0, 0))
nw_open_office_mid_length_x_m = Panel("12.25")
glass_plane_y_0_01_m = Panel("9.730")
no_context = Brep()
mask_lift = Panel("0.05")
sun_path_lift = Panel("0.10")
d1000_2 = RemoteReceiver(d1000)
d1250_2 = RemoteReceiver(d1250)
d1500_2 = RemoteReceiver(d1500)
filter_2 = StreamFilter(Gate=diagram_context, Stream0=no_context, Stream1=brep_2)
d500_2 = RemoteReceiver(d500)
d750_2 = RemoteReceiver(d750)
d00_2 = RemoteReceiver(d00)
Z_3 = UnitZ(Factor=mask_lift)
pt_3 = ConstructPoint(XCoordinate=nw_open_office_mid_length_x_m, YCoordinate=glass_plane_y_0_01_m, ZCoordinate=diagram_mask_point_height)
Z_4 = UnitZ(Factor=sun_path_lift)
filter_3 = StreamFilter(
    Gate=diagram_overhang_d,
    Stream0=d00_2,
    Stream1=d500_2,
    Stream2=d750_2,
    Stream3=d1000_2,
    Stream4=d1250_2,
    Stream5=d1500_2)
move_2 = Move(Geometry=diagram_origin_move_me, Motion=Z_3)  # -> Geometry, Transform
move_3 = Move(Geometry=diagram_origin_move_me, Motion=Z_4)  # -> Geometry, Transform
clean_3 = CleanTree(RemoveNulls=True, RemoveInvalid=True, RemoveEmpty=False, Tree=filter_2)
number_slider_3 = Slider(42, range=0..90)
facade_orientation_for_lb_sky_mask = Panel("0")
vec2pt_2 = Vector2Pt(PointA=pt_3, PointB=move_2.Geometry, Unitize=False)  # -> Vector, Length
merge_7 = Merge(Data1=filter_3, Data2=clean_3)
diascale_2 = RemoteReceiver(diascale)
proj_2 = RemoteReceiver(proj)
diagram_sun_positions = ValueList({"All daylight hours": 0, "Occupied hours (08-18 Mon-Fri)": 1}, selected="Occupied hours (08-18 Mon-Fri)")
symask = LBSkyMask(context=merge_7, orientation=facade_orientation_for_lb_sky_mask, center=pt_3, scale=diascale_2, projection=proj_2)  # -> report, context_mask, orient_mask, strategy_mask, sky_mask, context_view, orient_view, strategy_view, sky_view; plug-in component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
_8760 = Panel("8760")
lng_5 = ListLength(List=cull)
occupied_hoys_count = Panel(lng_5)
series_2 = Series(Start=0, Step=1, Count=_8760)
move_4 = Move(Geometry=symask.context_mask, Motion=vec2pt_2.Vector)  # -> Geometry, Transform
move_5 = Move(Geometry=symask.orient_mask, Motion=vec2pt_2.Vector)  # -> Geometry, Transform
visible_sky_from_the_point_fraction_of_h = Panel(symask.sky_view)  # "visible sky from the point [fraction of hemisphere]"
sky_masked_by_roof_overhang_context_frac = Panel(symask.context_view)  # "sky masked by roof/overhang + context [fraction, incl. behind facade]"
dome_segments = Panel("7")
range = Range(Domain=Domain(0, 1), Steps=dome_segments)
overhang_context_mask_colour = ColourSwatch(SwatchColor=RGB(122, 122, 122))
behind_facade_mask_colour = ColourSwatch(SwatchColor=RGB(0, 0, 0))
filter_4 = StreamFilter(Gate=diagram_sun_positions, Stream0=series_2, Stream1=cull)
gradient = Gradient(
    LowerLimit=0,
    UpperLimit=1,
    Parameter=range,
    stops=[0: RGB(48, 18, 59), 0.0294: RGB(56, 40, 112), 0.0588: RGB(63, 62, 156), 0.0882: RGB(68, 82, 193), 0.118: RGB(70, 102, 221), 0.147: RGB(71, 122, 241)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])
t = Panel("NW Open Office | ")
sep_2 = Panel(" | context option ")
sep2 = Panel(" | z = ")
dome_legend_min_kwh_m2 = Panel("0")
dome_legend_max_kwh_m2 = Panel("60")
mcol = MeshColours(Mesh=move_5.Geometry, Colours=behind_facade_mask_colour)
mcol_2 = MeshColours(Mesh=move_4.Geometry, Colours=overhang_context_mask_colour)
ground_reflectance = Panel("0.35")
concat_8 = Concatenate(
    FragmentA=t,
    FragmentB=diagram_overhang_d,
    FragmentC=sep_2,
    FragmentD=diagram_context,
    FragmentE=sep2,
    FragmentF=diagram_mask_point_height)
north_3 = RemoteReceiver(north)
sun_legend_min_w_m2 = Panel("0")
sun_legend_max_w_m2 = Panel("1000")
sun_segments = Panel("11")
pt_4 = Point(<point referenced from the Rhino model>)
legendpar_2 = LBLegendParameters(
    min=dome_legend_min_kwh_m2,
    max=dome_legend_max_kwh_m2,
    seg_count=dome_segments,
    colors=gradient,
    base_plane=pt_4,
    seg_height=Slider(2.95, range=0..100))  # -> leg_par; plug-in component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
diagram_selection = Panel(concat_8)
legendpar_3 = LBLegendParameters(min=sun_legend_min_w_m2, max=sun_legend_max_w_m2, seg_count=sun_segments)  # -> leg_par; plug-in component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
diascale_3 = RemoteReceiver(diascale)
north_4 = RemoteReceiver(north)
diascale_4 = RemoteReceiver(diascale)
proj_3 = RemoteReceiver(proj)
proj_4 = RemoteReceiver(proj)

centerpt = RemoteSender(move_3.Geometry)
centerpt_2 = RemoteReceiver(centerpt)
diascale_5 = RemoteReceiver(diascale)
proj_5 = RemoteReceiver(proj)

# ----
# Radiation analysis
# 5
importepw = LBImportEPW(epw_file=downloadepw.epw_file)  # -> location, dry_bulb_temperature, dew_point_temperature, relative_humidity, wind_speed, wind_direction, direct_normal_rad, diffuse_horizontal_rad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; plug-in component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
diffhorirad = RemoteSender(importepw.diffuse_horizontal_rad)
dirhorirad = RemoteSender(importepw.direct_normal_rad)
loc = RemoteSender(importepw.location)
falsestart = LBFalseStartToggle(False)

diffhorirad_2 = RemoteReceiver(diffhorirad)
dirhorirad_2 = RemoteReceiver(dirhorirad)
loc_2 = RemoteReceiver(loc)
skymatrix = LBCumulativeSkyMatrix(
    north=north_3,
    location=loc_2,
    direct_rad=dirhorirad_2,
    diffuse_rad=diffhorirad_2,
    hoys=cull,
    ground_ref=ground_reflectance)  # -> report, sky_mtx; plug-in component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
dirhorirad_3 = RemoteReceiver(dirhorirad)
loc_3 = RemoteReceiver(loc)
skydome = LBSkyDome(
    sky_mtx=skymatrix.sky_mtx,
    center_pt=diagram_origin_move_me,
    scale=diascale_3,
    projection=proj_4,
    show_comp=Toggle(False),
    legend_par=legendpar_2)  # -> report, mesh, compass, legend, title, patch_vecs, patch_values, mesh_values, vis_set; plug-in component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
sunpath = LBSunPath(
    north=north_4,
    location=loc_3,
    hoys=filter_4,
    center_pt=move_3.Geometry,
    scale=diascale_4,
    projection=proj_3,
    legend_par=legendpar_3)  # -> report, vectors, altitudes, azimuths, hoys, sun_pts, analemma, daily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; plug-in component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

# ----
# Select the analysis period
# dbT and hte Setpoints are required only for
# heating and cooling hours definition
list_2 = ValueList({"Annual": "{0}", "Winter": "{1}", "Spring": "{2}", "Summer": "{3}", "Fall": "{4}", "Heating hours": "{5}", "Cooling hours": "{6}"}, selected="Annual")
analysis_period_definition = AnalysisPeriodDefinition(analysis_period=list_2, dry_bulb_t=importepw.dry_bulb_temperature, heating_setpoint="20", cooling_setpoint="26")  # -> hoys, heating_and_cooling_deg, graphs_borders

data_21 = Data(skydome.mesh)
data_22 = Data(skydome.legend)
data_23 = Data(mcol_2)
data_24 = Data(mcol)
data_25 = Data([sunpath.sun_pts, sunpath.compass, sunpath.legend, sunpath.analemma, sunpath.daily])

# ----
# Turn on to visualise heating
# and cooling periods
swatch_2 = ColourSwatch(SwatchColor=RGB(191, 191, 191))  # disabled
toggle = GroupToggle(ToggleActive=True, ToggleVisible=False)  # disabled
preview_3 = CustomPreview(Geometry=analysis_period_definition.graphs_borders, Material=swatch_2)  # disabled
data_26 = Data(analysis_period_definition.heating_and_cooling_deg)  # disabled

loc_4 = RemoteReceiver(loc)

# ---- group: HOUR LABELS + PEAK WINDOW (native LB)
# note: Hour labels = clock time (UTC+4) on 21 June; orange = peak window May-Jul 08:00-11:00 (hours with >= 80 % of the annual peak façade solar load, all runs)
peak_window_may_jul_08_11_end_month = Panel("7")
peak_window_may_jul_08_11_start_hour = Panel("8")
peak_window_may_jul_08_11_end_day = Panel("31")
peak_window_may_jul_08_11_end_hour = Panel("11")
peak_window_may_jul_08_11_start_day = Panel("1")
peak_window_may_jul_08_11_start_month = Panel("5")
hour_labels_21_jun_start_month = Panel("6")
hour_labels_21_jun_start_day = Panel("21")
hour_labels_21_jun_start_hour = Panel("4")
hour_labels_21_jun_end_month = Panel("6")
hour_labels_21_jun_end_day = Panel("21")
hour_labels_21_jun_end_hour = Panel("20")
analysisperiod_2 = LBAnalysisPeriod(
    start_month=peak_window_may_jul_08_11_start_month,
    start_day=peak_window_may_jul_08_11_start_day,
    start_hour=peak_window_may_jul_08_11_start_hour,
    end_month=peak_window_may_jul_08_11_end_month,
    end_day=peak_window_may_jul_08_11_end_day,
    end_hour=peak_window_may_jul_08_11_end_hour)  # -> period, hoys, dates; plug-in component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
analysisperiod_3 = LBAnalysisPeriod(
    start_month=hour_labels_21_jun_start_month,
    start_day=hour_labels_21_jun_start_day,
    start_hour=hour_labels_21_jun_start_hour,
    end_month=hour_labels_21_jun_end_month,
    end_day=hour_labels_21_jun_end_day,
    end_hour=hour_labels_21_jun_end_hour)  # -> period, hoys, dates; plug-in component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
sunpath_2 = LBSunPath(north=north_2, location=loc_4, hoys=analysisperiod_2.hoys, center_pt=centerpt_2, scale=diascale_5, projection=proj_5)  # -> report, vectors, altitudes, azimuths, hoys, sun_pts, analemma, daily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; plug-in component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
sunpath_3 = LBSunPath(north=north_2, location=loc_4, hoys=analysisperiod_3.hoys, center_pt=centerpt_2, scale=diascale_5, projection=proj_5)  # -> report, vectors, altitudes, azimuths, hoys, sun_pts, analemma, daily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; plug-in component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
hours_day = Panel("24")
peak_window_preview = CustomPreview(Geometry=sunpath_2.sun_pts, Material=ColourSwatch(SwatchColor=RGB(234, 90, 0)))
label_format = Panel("{0:00}:00")
hour = Modulus(A=sunpath_3.hoys, B=hours_day)
label_size_m = Panel("0.9")
format = Format(Format=label_format, Culture=127, Data0=hour)  # "hh:00"
hour_labels = TextTag3D(Location=sunpath_3.sun_pts, Text=format, Size=label_size_m, Justification=7)

# ----
# 6
results_folder_2 = Panel("C:\Users\Vishnu\simulation\Radiation_HB_Model_Baseline\annual_irradiance\results\total")  # disabled
cumulvalues_2 = HBAnnualCumulativeValues(results=flatten(results_folder_2))  # -> report, values; disabled; plug-in component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
panel_9 = Panel("""Annual
Winter
Spring
Summer
Fall
Heating hours
Cooling hours""")  # disabled
panel_10 = Panel("Solar Radiation - ")  # disabled
toggle_2 = BooleanToggle(False)  # disabled
bnd = Bounds(Numbers=cumulvalues_2.values)  # disabled
panel_11 = Panel("10")  # disabled
panel_12 = Panel("14")  # disabled
panel_13 = Panel("0")  # disabled
panel_14 = Panel("478")  # disabled
branch = TreeBranch(Tree=simplify(graft(panel_9)), Path=list_2, MaintainPaths=True)  # disabled
legendpar_4 = LBLegendParameters(min=panel_12, max=panel_14, continuous_leg=toggle_2, num_decimals=panel_13)  # -> leg_par; disabled; plug-in component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
panel_15 = Panel(cumulvalues_2.values)  # disabled
concat_9 = Concatenate(FragmentA=panel_10, FragmentB=branch)  # disabled
analysismesh_3 = RemoteReceiver(analysismesh)  # disabled
data_27 = Data(cumulvalues_2.values)  # disabled
panel_16 = Panel("kWh/m2")  # disabled
match = MatchTree(Tree=data_27, Guide=analysismesh_3)  # disabled
heatmap_2 = LBSpatialHeatmap(values=match, mesh=analysismesh_3, legend_par=legendpar_4, legend_title=panel_16, global_title=concat_9)  # -> mesh, legend, title, colors, legend_par, vis_set; disabled; plug-in component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
bang = ExplodeTree(Data=heatmap_2.legend)  # -> _00000, _00001, _00002, _00003, _01000; disabled

sensorarea_4 = RemoteReceiver(sensorarea)  # disabled
multiplication_4 = Multiplication(A=match, B=sensorarea_4)  # disabled
pshift_11 = ShiftPaths(Data=sensorarea_4, Offset=-1)  # disabled
pshift_12 = ShiftPaths(Data=multiplication_4, Offset=-1)  # disabled
ma_5 = MassAddition(Input=pshift_11)  # -> Result, PartialResults; disabled
ma_6 = MassAddition(Input=pshift_12)  # -> Result, PartialResults; disabled
total_kwh = Panel(ma_6.Result)  # disabled
area_m2 = Panel(ma_5.Result)  # disabled
division_4 = Division(A=total_kwh, B=ma_5.Result)  # disabled
kwh_m2 = Panel(division_4)  # disabled

sort_2 = SortList(Keys=match)  # -> Keys, ValuesA; disabled
item_6 = ListItem(List=sort_2.Keys, Index=0, Wrap=True)  # -> Item1, Item; disabled
panel_17 = Panel([item_6.Item1, item_6.Item])  # disabled

# ---- group: Results display
results_mesh = Mesh(heatmap_2.mesh)  # disabled
legend_2 = Data(bang._01000)  # disabled
toggle_3 = GroupToggle(ToggleActive=True, ToggleVisible=False)  # disabled

# ----
wea = HBWeaFromEPW(epw_file=downloadepw.epw_file, hoys=analysis_period_definition.hoys)  # -> wea; plug-in component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

sky_filter = StreamFilter(Gate=sky, Stream0=wea, Stream1=tauclearsky)

annualirradiance = HBAnnualIrradiance(
    model=assigngridsviews,
    wea=sky_filter,
    north=addition_2,
    radiance_par=py3_2.rad_params,
    run_settings=recipesettings,
    run=falsestart)  # -> report, results, res_direct, avg_irr, peak_irr, radiation; plug-in component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

data_28 = Data(annualirradiance.results)

# ----
# A. HOURLY  Σ(a_i × I_i(t))  PER SENSOR GRID  [W]
# I_i(t) = hourly irradiance on sensor i [W/m²] (HB Annual Results to Data)
# a_i = sensor face area [m²] (LB Generate Point Grid face_areas)
# Copy the panel (right-click > Copy Data Only) into sheet 'D0000' (or the sheet of this overhang depth), cell F20.
sensorarea_5 = RemoteReceiver(sensorarea)  # disabled
operator = Panel("*")  # disabled
operator_2 = Panel("+")  # disabled
results_folder_3 = Panel(cumulvalues.values)  # disabled
hours_yr = Panel("8760")  # disabled
splitzonesnames_3 = RemoteReceiver(splitzonesnames)  # disabled
tab_separator_2 = Panel("\t")  # disabled
join_4 = TextJoin(Text=flatten(splitzonesnames_3), Join=tab_separator_2)  # disabled

sensorpts_2 = RemoteReceiver(sensorpts)  # disabled
data_29 = Data(data_28)  # disabled
annualtodata = HBAnnualResultsToData(results=results_folder, sel_pts=sensorpts_2, all_pts=sensorpts_2)  # -> report, data; disabled; plug-in component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
xdata = LBDeconstructData(data=annualtodata.data)  # -> header, values; disabled; plug-in component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
multiplication_5 = Multiplication(A=graft(sensorarea_5), B=xdata.values)  # disabled
path_mapper = PathMapper(multiplication_5, source="{A;B;C}(i)", target="{A;B;i}(C)")  # disabled
data_30 = Data(path_mapper)  # disabled
ma_7 = MassAddition(Input=data_30)  # -> Result, PartialResults; disabled
pshift_13 = ShiftPaths(Data=ma_7.Result, Offset=-1)  # disabled
export_hourly_σa_i_per_grid_w = Panel(pshift_13)  # disabled

arithop = LBArithmeticOperation(data_1=annualtodata.data, data_2=sensorarea_5, operator=operator)  # -> data; disabled; plug-in component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
massarithop = LBMassArithmeticOperation(data=arithop, operator=operator_2)  # -> data; disabled; plug-in component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
xdata_2 = LBDeconstructData(data=massarithop)  # -> header, values; disabled; plug-in component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
partition_2 = PartitionList(List=flatten(xdata_2.values), Size=hours_yr)  # disabled
flip_3 = FlipMatrix(Data=partition_2)  # disabled
join_5 = TextJoin(Text=flip_3, Join=tab_separator_2)  # disabled
merge_8 = Merge(Data1=flatten(join_4), Data2=flatten(join_5))  # disabled
export_hourly_σa_i_per_grid_w_2 = Panel(merge_8)  # disabled

# ----
# NOTE: this peak chain is per sensor grid, not coincident per zone.
# Use 'Zone Results (Pass 1)' (peak_kw / p99_occ_kw) instead.
data_31 = Data(data_28)  # disabled
toggle_4 = BooleanToggle(True)  # disabled
peakvalues = HBAnnualPeakValues(results=flatten(data_31), coincident=toggle_4)  # -> report, hoys, values; disabled; plug-in component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
sensorarea_6 = RemoteReceiver(sensorarea)  # disabled
multiplication_6 = Multiplication(A=sensorarea_6, B=peakvalues.values)  # disabled
facadezones = RemoteReceiver()  # disabled
peakirr_w = Data(multiplication_6)  # disabled

# ---- group: FSA
area_6 = Area(Geometry=facadezones)  # -> Area, Centroid; disabled

# ----
division_5 = Division(A=peakirr_w, B=area_6.Area)  # disabled
w_fsa = Panel(division_5)  # disabled

# ==== cluster AnalysisPeriodDefinition
analysis_period = ClusterInput()
dry_bulb_t = ClusterInput()  # dry bulb temperature from the EPW
heating_setpoint = ClusterInput()
cooling_setpoint = ClusterInput()
hdd_cdd = LBDegreeDays(dry_bulb=dry_bulb_t, heat_base=heating_setpoint, cool_base=cooling_setpoint)  # -> hourly_heat, hourly_cool, heat_deg_days, cool_deg_days; plug-in component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
xdata = LBDeconstructData(data=hdd_cdd.hourly_heat)  # -> header, values; plug-in component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
xdata_2 = LBDeconstructData(data=hdd_cdd.hourly_cool)  # -> header, values; plug-in component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
colrange = LBColorRange(index=Slider(11, range=0..26))  # -> colors; plug-in component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
colrange_2 = LBColorRange(index=Slider(10, range=0..26))  # -> colors; plug-in component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
expression = Expression(x=xdata.values, Expression="if(x>0,1,0)")
expression_2 = Expression(x=xdata_2.values, Expression="if(x>0,1,0)")
range = Range(Domain=Domain(0, 8759), Steps=8759)
legendpar = LBLegendParameters(colors=colrange, continuous_leg=Toggle(False))  # -> leg_par; plug-in component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
legendpar_2 = LBLegendParameters(colors=colrange_2, continuous_leg=Toggle(False))  # -> leg_par; plug-in component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
python = GhPythonScript()  # -> Annual, Winter, Spring, Summer, Autumn
# ---------- python: Python ----------
# Define the number of hours in a year
hours_in_a_year = 365 * 24

# Create lists for each season
winter_hours = []
spring_hours = []
summer_hours = []
autumn_hours = []
annual_hours = []

# Assign hours to seasons
for hour in range(hours_in_a_year):
    # Calculate the day of the year (0 to 364)
    day_of_year = hour // 24

    # Add the hour to the annual list
    annual_hours.append(hour)
    
    # Assign hours to seasons based on approximate dates
    if day_of_year < 79 or day_of_year >= 355:  # Winter: Jan 1 - Mar 19, Dec 21 - Dec 31
        winter_hours.append(hour)
    elif 79 <= day_of_year < 171:  # Spring: Mar 20 - Jun 20
        spring_hours.append(hour)
    elif 171 <= day_of_year < 263:  # Summer: Jun 21 - Sep 21
        summer_hours.append(hour)
    elif 263 <= day_of_year < 355:  # Fall: Sep 22 - Dec 20
        autumn_hours.append(hour)

# Print the first few hours for each season to verify
Winter = winter_hours
Spring = spring_hours
Summer = summer_hours
Autumn = autumn_hours
Annual = annual_hours
# ---------- end python ----------
dispatch = Dispatch(List=range, DispatchPattern=expression)  # -> ListA, ListB
dispatch_2 = Dispatch(List=range, DispatchPattern=expression_2)  # -> ListA, ListB
entwine = Entwine(
    Branch00=python.Annual,
    Branch01=python.Winter,
    Branch02=python.Spring,
    Branch03=python.Summer,
    Branch04=python.Autumn,
    Branch05=dispatch.ListA,
    Branch06=dispatch_2.ListA,
    FlattenInputs=True)
branch = TreeBranch(Tree=simplify(entwine), Path=analysis_period, MaintainPaths=True)
hoys = ClusterOutput(branch)
hourlyplot = LBHourlyPlot(data=[hdd_cdd.hourly_heat, hdd_cdd.hourly_cool], x_dim="0.1", y_dim="0.4", legend_par=[legendpar_2, legendpar])  # -> report, mesh, legend, borders, labels, title, vis_set; plug-in component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
data = Data([hourlyplot.mesh, hourlyplot.legend, hourlyplot.labels, hourlyplot.title])
graphs_borders = ClusterOutput(hourlyplot.borders)
heating_and_cooling_deg = ClusterOutput(data)
