# Grasshopper definition 261026 EOC vr Daylight And Visual Comfort_HB - 1.10 [Oct-27 '26, 1728].gh (Grasshopper 1.0.8)
# plug-ins: Karamba3D, Human, LadybugGrasshopper, MetaHopper, Telepathy

pipeline = GeometryPipeline(
    GroupByLayer=False,
    GroupByType=False,
    IncludeHidden=True,
    IncludeLocked=True,
    LayerFilter="EOC::Glazed Facade::North",
    NameFilter="*",
    SublayerFiltering=True,
    TypeFilter=1073741848)
geo = Geometry(pipeline)
geo_2 = Geometry(geo)
area = Area(Geometry=geo_2)  # -> Area, Centroid
pdecon = Deconstruct(Point=area.Centroid)  # -> XComponent, YComponent, ZComponent
sort = SortList(Keys=pdecon.XComponent, ValuesA=geo_2)  # -> Keys, ValuesA
sift = SiftPattern(List=sort.ValuesA, SiftPattern=[0, 1, 0])  # -> Output0, Output1
Z = UnitZ(Factor="5")
crv = Curve([<curve referenced from the Rhino model> x4])
srf = Surface(reparameterize(sift.Output1))
extr = Extrude(Base=crv, Direction=Z)
graft = GraftTree(Tree=sift.Output0, IncludeEmptyLists=True, IncludeNullItems=True)
pipeline_2 = GeometryPipeline(
    GroupByLayer=False,
    GroupByType=False,
    IncludeHidden=True,
    IncludeLocked=True,
    LayerFilter="EOC::Glazed Facade::West",
    NameFilter="*",
    SublayerFiltering=True,
    TypeFilter=1073741848)
pipeline_3 = GeometryPipeline(
    GroupByLayer=False,
    GroupByType=False,
    IncludeHidden=True,
    IncludeLocked=True,
    LayerFilter="EOC::Glazed Facade::East",
    NameFilter="*",
    SublayerFiltering=True,
    TypeFilter=1073741848)
splitmul = SplitBrepMultiple(Brep=srf, Cutters=extr)  # -> reverse(Result)
partition = PartitionList(List=flatten(splitmul), Size=[1, 3, 1])
geo_3 = Geometry(pipeline_3)
geo_4 = Geometry(pipeline_2)
debrep = DeconstructBrep(Brep=partition)  # -> simplify(Faces), Edges, Vertices
entwine = Entwine(Branch00=geo_4, Branch02=geo_3, FlattenInputs=True)
join = JoinCurves(Curves=debrep.Edges, Preserve=False)
boundary = BoundarySurfaces(Edges=join)
pshift = ShiftPaths(Data=boundary, Offset=-2)
clean = CleanTree(RemoveNulls=True, RemoveInvalid=True, RemoveEmpty=True, Tree=entwine)
clean_2 = CleanTree(RemoveNulls=True, RemoveInvalid=True, RemoveEmpty=True, Tree=graft)
merge = Merge(Data1=clean, Data2=clean_2, Data3=pshift)
tstat = TreeStatistics(Tree=merge)  # -> Paths, Length, Count
item = ListItem(List=tstat.Paths, Index=Slider(1, range=0..10), Wrap=True)
split = SplitTree(Data=merge, Masks=flatten(item))  # -> graft(Positive), Negative
group = Group(Geometry=split.Negative)  # -> graft(Group)
ungroup = Ungroup(Group=group)
pshift_2 = ShiftPaths(Data=ungroup, Offset=-1)
merge_2 = Merge(Data1=split.Positive, Data2=pshift_2)
data = Data(merge_2)
bbox = BoundingBox(Content=flatten(data), Plane=PlaneXY(0, 0, 0), UnionBox=True)  # -> Box, Box_2
debrep_2 = DeconstructBrep(Brep=data)  # -> simplify(Faces), Edges, Vertices
number_slider = Slider(5, range=0..10)  # disabled
md_slider = MDSlider(SliderMode=0, slider_value=Point(0.5, 0.5, 0.5), x_domain=Domain(0, 1), y_domain=Domain(0, 1), z_domain=Domain(0, 1))
volume = Volume(Geometry=bbox.Box)  # -> Volume, Centroid
evalsrf = EvaluateSurface(Surface=reparameterize(graft(debrep_2.Faces)), Point=md_slider)  # -> Point, simplify(Normal), UDirection, VDirection, Frame
pt = Point(volume.Centroid)
cs = CSharpScript(T=merge_2, i=number_slider)  # -> out, a; inputs T: tree, i: Int32; disabled
# ---------- cs: C# ----------
// Grasshopper Script Instance
#region Usings
using System;
using System.Collections;
using System.Collections.Generic;
using System.Drawing;

using Rhino;
using Rhino.Geometry;

using Grasshopper;
using Grasshopper.Kernel;
using Grasshopper.Kernel.Data;
using Grasshopper.Kernel.Types;
#endregion

public class Script_Instance : GH_ScriptInstance
{
    #region Notes
    /* 
      Members:
        RhinoDoc RhinoDocument
        GH_Document GrasshopperDocument
        IGH_Component Component
        int Iteration

      Methods (Virtual & overridable):
        Print(string text)
        Print(string format, params object[] args)
        Reflect(object obj)
        Reflect(object obj, string method_name)
    */
    #endregion

    private void RunScript(DataTree<object> T, int i, ref object a)
    {
        int count = T.BranchCount;
        if (i<0 || i> count -1)
        {
            this.Component.AddRuntimeMessage(GH_RuntimeMessageLevel.Error, "Index must be smaller than the branch count");
            return;
        }

        DataTree<object> outTree = new DataTree<object>(); 
        GH_Path path = T.Paths[i];
        List<object> branchList = T.Branch(path);

        outTree.AddRange(branchList, path);
        
        a = outTree;
        IGH_Component igc = this.Component as IGH_Component;
        igc.Message = path.ToString();
        //a = outTree;

        
    }
}
# ---------- end cs ----------
vec2pt = Vector2Pt(PointA=evalsrf.Point, PointB=pt, Unitize=False)  # -> Vector, Length
multiplication = Multiplication(A=evalsrf.Normal, B="10")
dprod = DotProduct(VectorA=vec2pt.Vector, VectorB=evalsrf.Normal, Unitize=True)
vdis = VectorDisplay(Anchor=evalsrf.Point, Vector=multiplication)
smaller = SmallerThan(FirstNumber=dprod, SecondNumber=0)  # -> SmallerThan, OrEqualTo
sift_2 = SiftPattern(List=graft(data), SiftPattern=smaller.SmallerThan)  # -> Output0, Output1
flip = Flip(Surface=sift_2.Output0)  # -> Surface, Result
combine = CombineData(Input0=flip.Surface, Input1=sift_2.Output1)  # -> Result, Index
pshift_3 = ShiftPaths(Data=combine.Result, Offset=-1)
pt_2 = Point(<point referenced from the Rhino model>)
area_2 = Area(Geometry=pshift_3)  # -> Area, Centroid
circle = CircleCNR(Center=pt_2, Normal=Vector(0, 0, 1), Radius=1)
alongcrv = SortAlongCurve(Points=area_2.Centroid, Curve=circle)  # -> Points, Indices
item_2 = ListItem(List=pshift_3, Index=alongcrv.Indices, Wrap=True)

# ----
# HOW TO USE (per overhang run)
# 1. Run the simulation (model name ..._D0500 etc.)
# 2. Paste its results folder ...\annual_irradiance\results\total into 'Results folder'
# 3. Copy EXPORT grid table -> Excel sheet D####, cell A4
# 4. Copy EXPORT hourly -> same sheet, cell F20
number_slider_2 = Slider(1, range=0..1)
pipeline_4 = GeometryPipeline(
    GroupByLayer=False,
    GroupByType=False,
    IncludeHidden=True,
    IncludeLocked=True,
    LayerFilter="Areas",
    NameFilter="*",
    SublayerFiltering=True,
    TypeFilter=4)
lng = ListLength(List=pipeline_4)  # -> expr("x+1", Length)
dom = ConstructDomain(DomainStart=Slider(0, range=0..1), DomainEnd=number_slider_2)
range = Range(Domain=dom, Steps=lng)
cull_i = CullIndex(List=range, Indices=[0, -1], Wrap=True)
jitter = Jitter(List=cull_i, Jitter=1, Seed=Slider(36, range=0..100))  # -> Values, Indices
gradient = Gradient(
    LowerLimit=0,
    UpperLimit=1,
    Parameter=jitter.Values,
    stops=[0: RGB(243, 57, 0), 0.1: RGB(236, 27, 60), 0.2: RGB(210, 0, 118), 0.3: RGB(103, 0, 120), 0.4: RGB(39, 72, 161), 0.5: RGB(1, 192, 229), 0.6: RGB(18, 178, 90), 0.7: RGB(79, 186, 8), 0.8: RGB(220, 237, 32), 0.9: RGB(247, 159, 20), 1: RGB(243, 57, 0)])
area_3 = Area(Geometry=pipeline_4)  # -> expr("Round(x,2)", Area), Centroid
boundary_2 = BoundarySurfaces(Edges=pipeline_4)
ma = MassAddition(Input=area_3.Area)  # -> Result, PartialResults
tag = TextTag3D(Location=area_3.Centroid, Text=area_3.Area, Size=1, Justification=7)
preview = CustomPreview(Geometry=boundary_2, Material=gradient)
panel = Panel(ma.Result)

# ----
# NB the Rhino file mus be saved in meters
# before running the analysis
# Automatically changes input wire appearance
# Select components and click on button
# to change the input wire display
wireoptions = WireOptions({"Default": 0, "Faint": 1, "Hidden": 2}, selected="Hidden")
hidewires = HideWires(on=Button(), wire_type=wireoptions)
# ---------- hidewires: Python ----------
from Grasshopper.Kernel import GH_ParamWireDisplay
from Grasshopper.Kernel import GH_RuntimeMessageLevel 

# A dictionary of wire types 
wire_display = {'0':GH_ParamWireDisplay.default, 
                '1':GH_ParamWireDisplay.faint,
                '2':GH_ParamWireDisplay.hidden}

# Get selected components and change the wire display
if on:
    doc = ghenv.Component.OnPingDocument()
    sel_objs = doc.SelectedObjects()
    if not len(sel_objs):
        ghenv.Component.AddRuntimeMessage(GH_RuntimeMessageLevel.Warning, 'Nothing was selected')
    for sel_obj  in sel_objs:
        if hasattr(sel_obj, 'Params'):
            for p in sel_obj.Params.Input:
                p.WireDisplay = wire_display[wire_type]
        else:
                sel_obj.WireDisplay = wire_display[wire_type]
# ---------- end hidewires ----------

# ----
# DigitalDesign Tools - Group DR
# Honeybee Radiation Analysis
# LG
# 30/09/2025
# Grasshopper version 1.0.0008
# Profiler (shows script bottle-necks)
# Enable to get list of components in time order,
# double click component to centre on screen
button = Button()
profiler = Profiler(run=button)
# ---------- profiler: VB usings ----------
Imports System.IO
Imports System.Linq
Imports System.Data
Imports System.Drawing
Imports System.Reflection
Imports System.Windows.Forms
Imports System.Xml
Imports System.Xml.Linq
Imports Microsoft.VisualBasic
Imports System.Runtime.InteropServices

Imports Rhino.DocObjects
Imports Rhino.Collections
Imports GH_IO
Imports GH_IO.Serialization
# ---------- profiler: VB ----------
    add_lists()

    If (run) Then
      If (_form IsNot Nothing) Then Return

      _form = New Form()
      _form.StartPosition = FormStartPosition.CenterScreen
      _form.ShowInTaskbar = False
      _form.FormBorderStyle = FormBorderStyle.SizableToolWindow
      _form.Text = "Component List"
      AddHandler _form.FormClosing, AddressOf FormClosing

      _list = New ListView()
      _list.View = View.Details
      _list.AllowColumnReorder = False
      _list.MultiSelect = False
      _list.Columns.Add("Component", 200)
      _list.Columns.Add("Runtime", 80)
      _list.Dock = DockStyle.Fill
      AddHandler _list.ItemActivate, AddressOf ItemActivate
      _form.Controls.Add(_list)

      'Grasshopper.GUI.GH_WindowsFormUtil.CenterFormOnCursor(_form, True)
      _form.Show(Instances.DocumentEditor)
      Instances.DocumentEditor.FormShepard.RegisterForm(_form)

      If (_handler) Then Return
      AddHandler GrasshopperDocument.SolutionEnd, AddressOf DocumentSolutionEnd
    End If
# ---------- profiler: VB additional code ----------
  Private _form As Form
  Private _list As ListView
  Private _handler As Boolean = False

  Private Sub FormClosing(sender As Object, e As EventArgs)
    If (_form Is Nothing) Then Return
    RemoveHandler _form.FormClosing, AddressOf FormClosing
    RemoveHandler _list.ItemActivate, AddressOf ItemActivate

    _form = Nothing
    _list = Nothing
  End Sub
  Private Sub ItemActivate(sender As Object, e As EventArgs)
    Try
      Dim item As ListViewItem = _list.SelectedItems(0)
      Dim target As RectangleF = TryCast(item.Tag, IGH_DocumentObject).Attributes.Bounds
      Dim view As New Grasshopper.GUI.Canvas.GH_NamedView(Instances.ActiveCanvas.Viewport.ScreenPort, target)
      view.SetToViewport(Instances.ActiveCanvas, 350)
    Catch
    End Try
  End Sub

  Private Sub DocumentSolutionEnd(sender As Object, e As GH_SolutionEventArgs)
    If (_form Is Nothing) Then Return
    _list.Items.Clear()

    Dim doc As GH_Document = e.Document
    If (doc Is Nothing) Then Return
    If (doc.ObjectCount = 0) Then Return

    Dim times As Int64()
    Dim objects As IGH_DocumentObject()
    ReDim times(doc.ObjectCount - 1)
    ReDim objects(doc.ObjectCount - 1)
    For i As Int32 = 0 To doc.ObjectCount - 1
      Dim obj As IGH_ActiveObject = TryCast(doc.Objects(i), IGH_ActiveObject)
      If (obj Is Nothing) Then
        times(i) = 0
        objects(i) = doc.Objects(i)
        Continue For
      End If

      times(i) = obj.ProcessorTime.Ticks
      objects(i) = obj
    Next
    Array.Sort(times, objects)

    For i As Int32 = doc.ObjectCount - 1 To 0 Step -1
      If (times(i) < TimeSpan.TicksPerMillisecond) Then Continue For
      Dim item As New ListViewItem(objects(i).Name)
      item.Tag = objects(i)
      item.SubItems.Add(String.Format("{0:0} ms", New TimeSpan(times(i)).TotalMilliseconds))
      _list.Items.Add(item)
    Next
    _list.Invalidate()
  End Sub

  Public Sub add_lists()
    If (Component.Params.Input(0).SourceCount = 0) Then
      Component.Attributes.PerformLayout()
      Dim grpList As Grasshopper.Kernel.Special.GH_ButtonObject
      grpList = New Grasshopper.Kernel.Special.GH_ButtonObject
      grpList.CreateAttributes()
      grpList.Attributes.Pivot = New System.Drawing.PointF(Component.Attributes.DocObject.Attributes.Bounds.Left - 1.2 * grpList.Attributes.Bounds.Width, Component.Attributes.DocObject.Attributes.Bounds.Top + 3)

      GrasshopperDocument.AddObject(grpList, False)
      Component.Params.Input(0).AddSource(grpList)
      Component.Params.OnParametersChanged()
      grpList.ExpireSolution(True)
    End If
  End Sub
# ---------- end profiler ----------

# ----
# Unit Conversion Factor
# mm to Rhino units
c_script = CSharpScript()  # -> factor
# ---------- c_script: C# ----------
    double f = 0;
    string units = Rhino.RhinoDoc.ActiveDoc.GetUnitSystemName(true, true, true, true);
    if (units == "mm") f = 1;
    else if (units == "m") f = 1000;
    else f = 1;

    factor = f;
# ---------- end c_script ----------
panel_2 = Panel(c_script)

# ----
# Automatically changes group colours based on tag
# Use to change the colour of groups based on
# the group name (changed by right-clicking the
# group and typing a name in the box)
group_button = Button()
panel_button = Button()
selected_only = BooleanToggle(True)
panel_3 = Panel("""Input
Output
WIP""")
colour_swatch = ColourSwatch(SwatchColor=RGBA(255, 255, 255, 100))
merge_3 = Merge(
    Data1=ColourSwatch(SwatchColor=RGBA(0, 255, 64, 100)),
    Data2=ColourSwatch(SwatchColor=RGBA(0, 64, 255, 100)),
    Data3=ColourSwatch(SwatchColor=RGBA(255, 0, 0, 100)))
group_color = SliderGroupColor(run=group_button, groupNames=panel_3, colors=merge_3, defaultColor=colour_swatch, selectedOnly=selected_only)  # inputs run: Boolean, groupNames: list of String, colors: list of Color, defaultColor: Color, selectedOnly: Boolean
# ---------- group_color: C# usings ----------
using System.Drawing;
using Grasshopper.Kernel.Special;
# ---------- group_color: C# ----------
    // Created by Timo Harboe Nielsen - Bjarke Ingels Group.

    if(!run){
      return;
    }
    GH_Document doc = owner.OnPingDocument();
    if (selectedOnly)
    {
      foreach (var dobj in doc.SelectedObjects())
      {
        GH_Group _group = dobj as GH_Group;
        if( _group == null){
          continue;
        }
        for(int i = 0; i < Math.Min(groupNames.Count, colors.Count); i++){
          string groupName = _group.NickName.ToString();
          string compareName = groupNames[i];
          if(groupName.IndexOf(compareName, StringComparison.OrdinalIgnoreCase) >= 0)
          {
            _group.Colour = colors[i];
            break;
          }
          else if(groupName == "")
          {
            _group.Colour = defaultColor;
          }
        }
      }
    }
    else
    {
      foreach (var dobj in doc.Objects)
      {
        GH_Group _group = dobj as GH_Group;
        if( _group == null){
          continue;
        }
        for(int i = 0; i < Math.Min(groupNames.Count, colors.Count); i++){
          string groupName = _group.NickName.ToString();
          string compareName = groupNames[i];
          if(groupName.IndexOf(compareName, StringComparison.OrdinalIgnoreCase) >= 0){
            _group.Colour = colors[i];
            break;
          }
          else if(groupName == "")
          {
            _group.Colour = defaultColor;
          }
        }
      }
    }
# ---------- end group_color ----------
group_color_2 = SliderGroupColor(run=panel_button, panelNames=panel_3, colors=merge_3, defaultColor=colour_swatch, selectedOnly=selected_only)  # inputs run: Boolean, panelNames: list of String, colors: list of Color, defaultColor: Color, selectedOnly: Boolean
# ---------- group_color_2: C# ----------
    // Created by Timo Harboe Nielsen - Bjarke Ingels Group.

    if(!run){
      return;
    }
    GH_Document doc = owner.OnPingDocument();
    if (selectedOnly)
    {
      foreach (var dobj in doc.SelectedObjects())
      {
        GH_Panel _group = dobj as GH_Panel;
        if( _group == null){
          continue;
        }
        for(int i = 0; i < Math.Min(panelNames.Count, colors.Count); i++){
          string groupName = _group.NickName.ToString();
          string compareName = panelNames[i];
          if(groupName.IndexOf(compareName, StringComparison.OrdinalIgnoreCase) >= 0)
          {
            _group.Properties.Colour = Color.FromArgb(colors[i].R, colors[i].G, colors[i].B);
            break;
          }
          else if(groupName == "")
          {
            _group.Properties.Colour = Color.FromArgb(defaultColor.R, defaultColor.G, defaultColor.B);
          }
        }
      }
    }
    else
    {
      foreach (var dobj in doc.Objects)
      {
        GH_Panel _group = dobj as GH_Panel;
        if( _group == null){
          continue;
        }
        for(int i = 0; i < Math.Min(panelNames.Count, colors.Count); i++){
          string groupName = _group.NickName.ToString();
          string compareName = panelNames[i];
          if(groupName.IndexOf(compareName, StringComparison.OrdinalIgnoreCase) >= 0){
            _group.Properties.Colour = Color.FromArgb(colors[i].R, colors[i].G, colors[i].B);
            break;
          }
          else if(groupName == "")
          {
            _group.Properties.Colour = Color.FromArgb(defaultColor.R, defaultColor.G, defaultColor.B);
          }
        }
      }
    }
# ---------- end group_color_2 ----------

# ----
# Style Guide:
# Hue:
# Sat: 100 (except white)
# Val: 100
# A: 100
data_2 = Data(0)

# ---- group: General
# Text Size: 25 (medium), 12 (small), 50 (large), 100 (extra large)
# Font: Microsoft Sans Serif
data_3 = Data(0)

# ---- group: 45
# 45
data_4 = Data(0)

# ---- group: 90
# 90
data_5 = Data(0)

# ---- group: 135
# 135
data_6 = Data(0)

# ---- group: Input
data_7 = Data(0)

# ---- group: 180
# 180
data_8 = Data(0)

# ---- group: 225
# 225
data_9 = Data(0)

# ---- group: Output
data_10 = Data(0)

# ---- group: 270
# 270
data_11 = Data(0)

# ---- group: 315
# 315
data_12 = Data(0)

# ---- group: 0
# 0
data_13 = Data(0)

# ---- group: WIP
data_14 = Data(0)

# ----
pipeline_5 = GeometryPipeline(
    GroupByLayer=False,
    GroupByType=False,
    IncludeHidden=True,
    IncludeLocked=True,
    LayerFilter="EOC::Context buildings",
    NameFilter="*",
    SublayerFiltering=True,
    TypeFilter=1073741848)
pipeline_6 = GeometryPipeline(
    GroupByLayer=False,
    GroupByType=False,
    IncludeHidden=True,
    IncludeLocked=True,
    LayerFilter="EOC::Modelled Context",
    NameFilter="*",
    SublayerFiltering=True,
    TypeFilter=1073741848)
context_drop_m = Panel("-0.02")
Z_2 = UnitZ(Factor=context_drop_m)
# Context
merge_4 = Merge(Data1=pipeline_5, Data2=pipeline_6)
move = Move(Geometry=merge_4, Motion=Z_2)  # -> Geometry, Transform
# For material definition please refer to
# HB-Radiance Material constructors.
# For more info about the material definition look
# at the Radiance manual:
# https://floyd.lbl.gov/radiance/refer/usman2.pdf
panel_4 = Panel("0.00")
opaquemod = HBOpaqueModifier(name="Context_Material", reflect="0.3", spec="0.00", rough=panel_4)  # -> modifier; plug-in component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
brep = Brep(merge_4)
face = HBFace(geo=brep, rad_mod=opaquemod)  # -> out, faces; plug-in component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

# ----
# Opaque Facade
pipeline_7 = GeometryPipeline(
    GroupByLayer=False,
    GroupByType=False,
    IncludeHidden=True,
    IncludeLocked=True,
    LayerFilter="EOC::Opaque Facade::Timber",
    NameFilter="*",
    SublayerFiltering=True,
    TypeFilter=1073741848)
pipeline_8 = GeometryPipeline(
    GroupByLayer=False,
    GroupByType=False,
    IncludeHidden=True,
    IncludeLocked=True,
    LayerFilter="EOC::Opaque Facade::Concrete",
    NameFilter="*",
    SublayerFiltering=True,
    TypeFilter=1073741848)
opaquemod_2 = HBOpaqueModifier(name="Opaque_Facade_Material", reflect="0.4", spec="0.00", rough="0.00")  # -> modifier; plug-in component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
opaquemod_3 = HBOpaqueModifier(name="Opaque_Facade_Material", reflect="0.4", spec="0.00", rough="0.00")  # -> modifier; plug-in component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
brep_2 = Brep(pipeline_7)
brep_3 = Brep(pipeline_8)
face_2 = HBFace(geo=brep_2, rad_mod=opaquemod_2)  # -> out, faces; plug-in component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
face_3 = HBFace(geo=brep_3, rad_mod=opaquemod_3)  # -> out, faces; plug-in component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

# ----
# Opaque Facade
pipeline_9 = GeometryPipeline(
    GroupByLayer=False,
    GroupByType=False,
    IncludeHidden=True,
    IncludeLocked=True,
    LayerFilter="EOC::Opaque Facade::Timber",
    NameFilter="*",
    SublayerFiltering=True,
    TypeFilter=1073741848)

# ----
# Skylight
panel_5 = Panel("Transparent_Roof_Material")
pipeline_10 = GeometryPipeline(
    GroupByLayer=False,
    GroupByType=False,
    IncludeHidden=True,
    IncludeLocked=True,
    LayerFilter="EOC::Skylight",
    NameFilter="*",
    SublayerFiltering=True,
    TypeFilter=1073741848)
skylight_path_in = Panel("{0}")
skylight_path_out_after_facade_zones = Panel("{0;3;0;0}")
opaquemod_4 = HBOpaqueModifier(name=panel_5, reflect="0.20", spec="0.00", rough="0.00")  # -> modifier; plug-in component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
brep_4 = Brep(pipeline_10)
face_4 = HBFace(geo=brep_4, rad_mod=opaquemod_4)  # -> out, faces; plug-in component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
replace = ReplacePaths(Data=brep_4, Search=skylight_path_in, Replace=skylight_path_out_after_facade_zones)

# ----
# 1
# Create/import geometry
number_slider_3 = Slider(4, range=0..10)
cs_2 = CSharpScript(T=item_2, i=Slider(0, range=0..10))  # -> out, a; inputs T: tree, i: Int32; same code as cs
item_3 = ListItem(List=cs_2.a, Index=number_slider_3, Wrap=True)

# ----
# Glazing
data_15 = Data(item_2)

opaquemod_5 = HBOpaqueModifier(name="Transparent_Facade_Material", reflect="0.20", spec="0.00", rough="0.00")  # -> modifier; plug-in component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
brep_5 = Brep(data_15)
face_5 = HBFace(geo=brep_5, rad_mod=opaquemod_5)  # -> out, faces; plug-in component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

# ----
# Exterior Ground
pipeline_11 = GeometryPipeline(
    GroupByLayer=False,
    GroupByType=False,
    IncludeHidden=True,
    IncludeLocked=True,
    LayerFilter="EOC::Ground",
    NameFilter="*",
    SublayerFiltering=True,
    TypeFilter=1073741848)
opaquemod_6 = HBOpaqueModifier(name="Ground_Material", reflect="0.35", spec="0.00", rough="0.00")  # -> modifier; plug-in component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
brep_6 = Brep(pipeline_11)
face_6 = HBFace(geo=brep_6, rad_mod=opaquemod_6)  # -> out, faces; plug-in component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

opaquemod_7 = HBOpaqueModifier(name="Opaque_Facade_Material", reflect="0.4", spec="0.00", rough="0.00")  # -> modifier; plug-in component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
brep_7 = Brep(pipeline_9)
face_7 = HBFace(geo=brep_7, rad_mod=opaquemod_7)  # -> out, faces; plug-in component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
merge_5 = Merge(Data1=brep_5, Data2=replace)

# ----
# Create mesh
# 3
facade_skylight_grids = Brep(merge_5)
panel_6 = Panel("""West_Office Rooms
North-West_Open Office
North_Pantry
North-East_Open Office
East_Office Rooms
Skylight""")
facade_sklightzones = RemoteSender(facade_skylight_grids)
data_16 = Data(facade_skylight_grids)
lng_2 = ListLength(List=data_16)
genpts = LBGeneratePointGrid(geometry=graft(data_16), grid_size=".4", offset_dist="0.05")  # -> points, vectors, face_areas, mesh; plug-in component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
repeat = RepeatData(Data=graft(panel_6), Length=lng_2)  # -> simplify(Data)
series = Series(Start=0, Step=1, Count=lng_2)  # -> simplify(Series)
zonesnames = RemoteSender(panel_6)
pshift_4 = ShiftPaths(Data=repeat, Offset=-1)
pshift_5 = ShiftPaths(Data=series, Offset=-1)
pshift_6 = ShiftPaths(Data=genpts.points, Offset=-1)
pshift_7 = ShiftPaths(Data=genpts.vectors, Offset=-1)
pshift_8 = ShiftPaths(Data=genpts.face_areas, Offset=-1)
pshift_9 = ShiftPaths(Data=genpts.mesh, Offset=-1)
repeatzonesnames = RemoteSender(pshift_4)
concat = Concatenate(FragmentA=pshift_4, FragmentB=pshift_5, JoinSeparator="_")  # -> graft(Result)
panel_7 = Panel(pshift_4)
sensorgrid = HBSensorGrid(name=concat, positions=pshift_6, directions=pshift_7, mesh=pshift_9)  # -> grid; plug-in component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
analysismesh = RemoteSender(pshift_9)
sensorpts = RemoteSender(pshift_6)
sensorarea = RemoteSender(pshift_8)
splitzonesnames = RemoteSender(concat)

# ----
# Check on the analysis srf:
# The Normal vector must point outwards
debrep_3 = DeconstructBrep(Brep=brep_5)  # -> simplify(graft(Faces)), Edges, Vertices
srf_2 = Surface(reparameterize(debrep_3.Faces))
area_4 = Area(Geometry=srf_2)  # -> Area, Centroid
srf_cp = SurfaceClosestPoint(Point=area_4.Centroid, Surface=srf_2)  # -> Point, UVPoint, Distance
evalsrf_2 = EvaluateSurface(Surface=reparameterize(srf_2), Point=srf_cp.UVPoint)  # -> Point, simplify(Normal), UDirection, VDirection, Frame
multiplication_2 = Multiplication(A=evalsrf_2.Normal, B=Slider(0.56, range=0..10))
vdis_2 = VectorDisplay(Anchor=evalsrf_2.Point, Vector=multiplication_2)

dom_2 = ConstructDomain(DomainStart=Slider(0.194, range=0..1), DomainEnd=Slider(1, range=0..1))
group_2 = Group(Geometry=merge_2)
py3 = Python3Script(someData=flatten(group_2), interval=dom_2, transparency=Slider(0.738, range=0..1))  # -> out, graft(Colors); inputs someData: list, interval: Interval, transparency: Double
# ---------- py3: Python ----------
import Rhino as rc
import math 
def valuesToRainbow(someData, interval, transparency):
    
    """ Make a list of colors along hue spectrum,
    meaning that 0.0 = red and 0.7 = blue """

    colors = []
    # domain = rc.Geometry.Interval(0.0, 0.9)
    domain = interval
    N = len(someData)
    interval = (domain.T1 - domain.T0) / N
    for i in range(len(someData)+1):
        val = domain.T0 + (interval * i)
        hsv = rc.Display.ColorHSV(val,transparency,1.0)
        rgb = hsv.ToArgbColor()
        colors.append(rgb)
        print (rgb)
    return colors




# Make visualisation colors
Colors = valuesToRainbow(someData, interval, transparency)
# ---------- end py3 ----------
swatch = ColourSwatch(SwatchColor=RGB(102, 102, 102))
material = CreateMaterial(Diffuse=py3.Colors, Specular=RGB(255, 255, 255), Emission=RGB(0, 0, 0), Transparency=0, Shine=0)
preview_2 = CustomPreview(Geometry=merge_2, Material=material)

join_2 = BrepJoin(Breps=merge_2)  # -> Breps, Closed
edges = BrepEdges(Brep=join_2.Breps)  # -> Naked, Interior, NonManifold
previewlw = CustomPreviewLineweights(Geometry=edges.Naked, Shader=ColourSwatch(SwatchColor=RGB(0, 0, 0)), Thickness=Slider(3.5, range=0..100), Absolute=False)

area_5 = Area(Geometry=item_2)  # -> Area, Centroid
ma_2 = MassAddition(Input=area_5.Area)  # -> Result, PartialResults
panel_8 = Panel(ma_2.Result)
pdecon_2 = Deconstruct(Point=py3.Colors)  # -> XComponent, YComponent, ZComponent
frgb = ColourRGBF(Alpha=1, Red=pdecon_2.XComponent, Green=pdecon_2.YComponent, Blue=pdecon_2.ZComponent)

sensorarea_2 = RemoteReceiver(sensorarea)
pshift_10 = ShiftPaths(Data=sensorarea_2, Offset=-1)
ma_3 = MassAddition(Input=pshift_10)  # -> flatten(Result), PartialResults
zonesnames_2 = RemoteReceiver(zonesnames)
num = Number(expr("Round(x,2)", flatten(ma_2.Result)))
concat_2 = Concatenate(FragmentA=num, FragmentB=" m² ")
concat_3 = Concatenate(FragmentA=zonesnames_2, FragmentC="FSA: ", FragmentB=concat_2)
legend = LegendKaramba3D(
    Colors=flatten(frgb),
    Tags=concat_3,
    Scale=0.8,
    Textsize=30,
    Viewport="Iso - Mark up",
    Legend_HasHeader=False,
    Legend_Justification=2,
    Legend_Position=2)

# ----
# Use to change the orientation of the analyzed site.
# The Rhino standard set North as the
# positive y axis direction (0),
# change the slider to rotate with 90° steps
# and the panel to add other angles.
orientation = Slider(0, range=0..3, expression="x*90")
addition = Addition(A=orientation, B="20")
origin = Point(Point(-5, -5, 0))
compass = LBCompass(north=addition, center=origin, scale="0.1")  # -> compass; plug-in component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
preview_3 = CustomPreview(Geometry=compass, Material=ColourSwatch(SwatchColor=RGB(0, 0, 0)))

radpar = HBRadianceParameter(recipe_type="2", detail_level="1")  # -> rad_par; plug-in component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

# ----
# From the EPWMap component
# set the toggle to true to access
# the online map. Select the EPW
# you need and copy the link in this panel
panel_9 = Panel("https://climate.onebuilding.org/WMO_Region_2_Asia/ARE_United_Arab_Emirates/ARE_DU_Dubai.Intl.AP.411940_TMYx.zip")
downloadepw = LBDownloadWeather(weather_URL=panel_9)  # -> epw_file, stat_file, ddy_file; plug-in component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

wea = HBWeaFromEPW(epw_file=downloadepw.epw_file)  # -> wea; plug-in component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
mesh = Mesh()

# ---- group: OVERHANG DEPTH SWITCH
# OVERHANG DEPTH SWITCH
# Pick the depth in 'Overhang D'. It selects the Roof + Context Wall layers of that depth (Rhino layers EOC::D###::...),
# names the HB model Radiation_HB_Model_D#### (own simulation folder) and points 'Results folder' to it.
sky = ValueList({"TMYx (typical year, annual)": 0, "Design day (ASHRAE clear sky, tau from STAT)": 1}, selected="TMYx (typical year, annual)")
overhang_d = ValueList({"D0000  (D00)": 0, "D0500  (D500)": 1, "D0750  (D750)": 2, "D1000  (D1000)": 3, "D1250  (D1250)": 4, "D1500  (D1500)": 5, "D1130  (Architect's option)": 6}, selected="D1500  (D1500)")
sky_labels = Panel("""TMYx
DesignDay""")
pipeline_12 = GeometryPipeline(
    GroupByLayer=False,
    GroupByType=False,
    IncludeHidden=True,
    IncludeLocked=True,
    LayerFilter="EOC::D00::Roof",
    NameFilter="*",
    SublayerFiltering=True,
    TypeFilter=1073741848)
pipeline_13 = GeometryPipeline(
    GroupByLayer=False,
    GroupByType=False,
    IncludeHidden=True,
    IncludeLocked=True,
    LayerFilter="EOC::D500::Roof",
    NameFilter="*",
    SublayerFiltering=True,
    TypeFilter=1073741848)
pipeline_14 = GeometryPipeline(
    GroupByLayer=False,
    GroupByType=False,
    IncludeHidden=True,
    IncludeLocked=True,
    LayerFilter="EOC::D750::Roof",
    NameFilter="*",
    SublayerFiltering=True,
    TypeFilter=1073741848)
pipeline_15 = GeometryPipeline(
    GroupByLayer=False,
    GroupByType=False,
    IncludeHidden=True,
    IncludeLocked=True,
    LayerFilter="EOC::D1000::Roof",
    NameFilter="*",
    SublayerFiltering=True,
    TypeFilter=1073741848)
pipeline_16 = GeometryPipeline(
    GroupByLayer=False,
    GroupByType=False,
    IncludeHidden=True,
    IncludeLocked=True,
    LayerFilter="EOC::D1250::Roof",
    NameFilter="*",
    SublayerFiltering=True,
    TypeFilter=1073741848)
pipeline_17 = GeometryPipeline(
    GroupByLayer=False,
    GroupByType=False,
    IncludeHidden=True,
    IncludeLocked=True,
    LayerFilter="EOC::D1500::Roof",
    NameFilter="*",
    SublayerFiltering=True,
    TypeFilter=1073741848)
item_4 = ListItem(List=sky_labels, Index=sky, Wrap=True)
sep = Panel("_")
d1000 = RemoteSender(pipeline_15)
d1250 = RemoteSender(pipeline_16)
d1500 = RemoteSender(pipeline_17)
d500 = RemoteSender(pipeline_13)
d750 = RemoteSender(pipeline_14)
d00 = RemoteSender(pipeline_12)
filter = StreamFilter(
    Gate=overhang_d,
    Stream0=pipeline_12,
    Stream1=pipeline_13,
    Stream2=pipeline_14,
    Stream3=pipeline_15,
    Stream4=pipeline_16,
    Stream5=pipeline_17)

model_name_prefix = Panel("Daylight_HB_Model_")
run_labels = Panel("""D0000
D0500
D0750
D1000
D1250
D1500
D1130""")
item_5 = ListItem(List=run_labels, Index=overhang_d, Wrap=True)
concat_4 = Concatenate(FragmentA=model_name_prefix, FragmentB=item_5, FragmentC=sep, FragmentD=item_4)
run_label_excel_sheet = Panel(item_5)
simulation_folder = Panel("C:\Users\Vishnu\simulation\DFF-context-zones-261019\")
results_sub_folder = Panel("\annual_irradiance\results\total")
concat_5 = Concatenate(FragmentA=simulation_folder, FragmentB=concat_4, FragmentC=results_sub_folder)

# ----
modelname = RemoteSender(concat_4)

# ---- group: OVERHANG DEPTH SWITCH (continued)
simfolderpath = RemoteSender(simulation_folder)

# ----
# 2
# Roof
panel_10 = Panel("Shading_Material")
opaquemod_8 = HBOpaqueModifier(name=panel_10, reflect="0.50", spec="0.00", rough="0.00")  # -> modifier; plug-in component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
# Create/import context
brep_8 = Brep(filter)
face_8 = HBFace(geo=brep_8, rad_mod=opaquemod_8)  # -> out, faces; plug-in component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

data_17 = Data([face_5.faces, face_3.faces, face_8.faces, face_6.faces, face.faces, face_4.faces, face_2.faces])

# ----
# 4
# HB Model Definition
modelname_2 = RemoteReceiver(modelname)
hb_model_name = Panel(modelname_2)
model = HBModel(faces=flatten(data_17), name=hb_model_name)  # -> report, model; plug-in component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

# ----
# Visualisation
faceradianceattr = HBFaceRadianceAttributes({"Modifier": "properties.radiance.modifier.display_name", "Average Reflectance": "properties.radiance.modifier.average_reflectance", "Average Transmittance": "properties.radiance.modifier.average_transmittance", "Modifier Blk": "properties.radiance.modifier_blk.display_name", "Is Opaque": "properties.radiance.is_opaque", "Dynamic Group": "properties.radiance.dynamic_group_identifier", "State Count": "properties.radiance.state_count", "States": "properties.radiance.states"}, selected="Average Reflectance")
assigngridsviews = HBAssignGridsAndViews(model=model.model, grids=flatten(sensorgrid))  # -> model; plug-in component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
colorfaceattr = HBColorFaceAttributes(hb_objs=flatten(model.model), attribute=faceradianceattr)  # -> mesh, legend, wire_frame, values, colors, vis_set; plug-in component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
vizwiref = HBVisualizeWireframe(hb_objs=flatten(assigngridsviews))  # -> geo; plug-in component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
data_18 = Data(colorfaceattr.mesh)

# ----
# 5
# Daylight analysis
# Daylight factor
# Annual daylight analysis
schedule = Panel("""0
0
0
0
0
0
0
0
0
1
1
1
1
1
1
1
1
1
0
0
0
0
0
0""")
ma_4 = MassAddition(Input=schedule)  # -> Result, PartialResults
constantschedule = HBConstantSchedule(values=schedule, name="Occupied_hours_SCHD", type_limit="Fractional")  # -> report, schedule, idf_text; plug-in component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
multiplication_3 = Multiplication(A=ma_4.Result, B="365")
occupied_hours = Panel(multiplication_3)
falsestart = LBFalseStartToggle(False)
falsestart_2 = LBFalseStartToggle(False)
annualdaylight = HBAnnualDaylight(
    model=assigngridsviews,
    wea=wea,
    north=addition,
    thresholds="-t 300",
    schedule=constantschedule.schedule,
    radiance_par=radpar,
    enhanced=Toggle(True),
    run=falsestart)  # -> report, results, DA, cDA, UDI, UDI_low, UDI_up; plug-in component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
daylightfactor = HBDaylightFactor(model=assigngridsviews, run=falsestart_2)  # -> report, results; plug-in component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

# ----
# Criteri Minimi Ambientali
# No target met
# 100 lx for 50% daylight hrs
# Ill. requirement met
# No target met
# 100 lx for 50% of daylight hrs
# 300 lx for 50% of daylight hrs
importepw = LBImportEPW(epw_file=downloadepw.epw_file)  # -> location, dry_bulb_temperature, dew_point_temperature, relative_humidity, wind_speed, wind_direction, direct_normal_rad, diffuse_horizontal_rad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; disabled; plug-in component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
xdata = LBDeconstructData(data=importepw.global_horizontal_ill)  # -> header, values; disabled; plug-in component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
panel_11 = Panel("1")  # disabled
panel_12 = Panel("1")  # disabled
panel_13 = Panel("12")  # disabled
panel_14 = Panel("23")  # disabled
panel_15 = Panel("0")  # disabled
panel_16 = Panel("31")  # disabled
analysisperiod = LBAnalysisPeriod(start_month=panel_11, start_day=panel_12, start_hour=panel_15, end_month=panel_13, end_day=panel_16, end_hour=panel_14)  # -> period, hoys, dates; disabled; plug-in component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
py3_2 = Python3Script(values=xdata.values)  # -> out, values; inputs values: list; disabled
# ---------- py3_2: Python ----------
values_SCHD = []
for val_i in values:
    if val_i == 0:
        values_SCHD.append(0)
    elif val_i > 0:
        values_SCHD.append(1)
    else:
        print('The process stopped, a value was not recognised')
        break

values = values_SCHD
# ---------- end py3_2 ----------
panel_17 = Panel("1")  # disabled
panel_18 = Panel("Daylight_hours_SCHD")  # disabled
panel_19 = Panel("Fractional")  # disabled
fixedintervalschedule = HBFixedIntervalSchedule(values=py3_2.values, timestep=panel_17, analysis_period=analysisperiod.period, name=panel_18, type_limit=panel_19)  # -> report, schedule; disabled; plug-in component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
list = ValueList({"Minimum", "Medium", "High"}, selected="Medium")  # disabled
py3_3 = Python3Script(rec_level=list)  # -> out, target_ill, min_target_ill, categories; disabled
#   port rec_level: Level of recommendation
# ---------- py3_3: Python ----------
rec_level_dict = {'Minimum': [300, 100],
                  'Medium': [500, 300],
                  'High': [750, 500]}

target_ill, min_target_ill = rec_level_dict[rec_level]
categories = ['No target met',
              f'{min_target_ill} lx for 50% of daylight hrs',
              f'{target_ill} lx for 50% of daylight hrs']
# ---------- end py3_3 ----------
daylightmetrics = HBAnnualDaylightMetrics(results=flatten(annualdaylight.results), occ_sch=fixedintervalschedule.schedule, threshold=py3_3.target_ill)  # -> report, DA, cDA, UDI, UDI_low, UDI_up; disabled; plug-in component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
daylightmetrics_2 = HBAnnualDaylightMetrics(results=flatten(annualdaylight.results), occ_sch=fixedintervalschedule.schedule, threshold=py3_3.min_target_ill)  # -> report, DA, cDA, UDI, UDI_low, UDI_up; disabled; plug-in component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
panel_20 = Panel("50")  # disabled
panel_21 = Panel("50")  # disabled
sda = HBSpatialDaylightAutonomy(DA=daylightmetrics.DA, mesh=flatten(mesh), target_time=panel_20)  # -> report, sDA, pass_fail; disabled; plug-in component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
sda_2 = HBSpatialDaylightAutonomy(DA=daylightmetrics_2.DA, mesh=flatten(mesh), target_time=panel_21)  # -> report, sDA, pass_fail; disabled; plug-in component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
min_ill_requirement = Panel(sda_2.sDA)  # disabled
ill_requirement = Panel(sda.sDA)  # disabled
swatch_2 = ColourSwatch(SwatchColor=RGB(146, 146, 146))  # disabled
swatch_3 = ColourSwatch(SwatchColor=RGB(161, 229, 75))  # disabled
swatch_4 = ColourSwatch(SwatchColor=RGB(106, 180, 196))  # disabled
merge_6 = Merge(Data1=swatch_2, Data2=swatch_4, Data3=swatch_3)  # disabled
panel_22 = Panel("""0.5
1.5""")  # disabled
legendparcategorized = LBLegendParametersCategorized(domain=panel_22, colors=merge_6, categories=py3_3.categories)  # -> leg_par; disabled; plug-in component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
py3_4 = Python3Script(target=sda.pass_fail, min_target=sda_2.pass_fail)  # -> out, value; disabled
# ---------- py3_4: Python ----------
if target == 1:
    value = 2
elif target == 0 and min_target == 1:
    value = 1
elif target == 0 and min_target == 0:
    value = 0
# ---------- end py3_4 ----------
heatmap = LBSpatialHeatmap(values=py3_4.value, mesh=mesh, legend_par=legendparcategorized)  # -> mesh, legend, title, colors, legend_par, vis_set; disabled; plug-in component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
toggle = GroupToggle(ToggleActive=True, ToggleVisible=False)  # disabled

# ----
# Compute sDA
swatch_5 = ColourSwatch(SwatchColor=RGB(146, 146, 146))
merge_7 = Merge(Data1=swatch_5, Data2=ColourSwatch(SwatchColor=RGB(161, 229, 75)))
sda_3 = HBSpatialDaylightAutonomy(DA=annualdaylight.DA, mesh=flatten(mesh), target_time="50")  # -> report, sDA, pass_fail; plug-in component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
panel_23 = Panel("""Non-daylit Area
Daylit Area""")
legendparcategorized_2 = LBLegendParametersCategorized(domain="0.5", colors=merge_7, categories=panel_23)  # -> leg_par; plug-in component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
sda_4 = Panel(sda_3.sDA)

# ----
# Compute ASE
swatch_6 = ColourSwatch(SwatchColor=RGB(146, 146, 146))
merge_8 = Merge(Data1=swatch_6, Data2=ColourSwatch(SwatchColor=RGB(249, 188, 28)))
ase = HBAnnualSunlightExposure(results=annualdaylight.results, occ_sch=constantschedule.schedule, threshold="1000", target_hrs="250")  # -> report, ASE, hrs_above; plug-in component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
panel_24 = Panel("""Non-overlit Area
Overlit Area""")
expression = Expression(x=ase.hrs_above, Expression="if(x > 250, 1, 0)")
legendparcategorized_3 = LBLegendParametersCategorized(domain="0.5", colors=merge_8, categories=panel_24)  # -> leg_par; plug-in component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
ase_2 = Panel(ase.ASE)

# ----
# 6
# Results
# Visualize Daylight Factor
panel_25 = Panel("0")
legendpar = LBLegendParameters(min=panel_25, max="10")  # -> leg_par; plug-in component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
mjoin = MeshJoin(Meshes=mesh)
data_19 = Data(daylightfactor.results)

# ----
# Daylight Autonomy
panel_26 = Panel("85")
legendpar_2 = LBLegendParameters(min=panel_26, max="100")  # -> leg_par; plug-in component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
mjoin_2 = MeshJoin(Meshes=mesh)
data_20 = Data(annualdaylight.DA)

heatmap_2 = LBSpatialHeatmap(values=data_19, mesh=mjoin, legend_par=legendpar, legend_title="DF")  # -> mesh, legend, title, colors, legend_par, vis_set; disabled; plug-in component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
toggle_2 = GroupToggle(ToggleActive=True, ToggleVisible=False)  # disabled

heatmap_3 = LBSpatialHeatmap(values=data_20, mesh=mjoin_2, legend_par=legendpar_2, legend_title="%")  # -> mesh, legend, title, colors, legend_par, vis_set; disabled; plug-in component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
toggle_3 = GroupToggle(ToggleActive=True, ToggleVisible=False)  # disabled

heatmap_4 = LBSpatialHeatmap(values=sda_3.pass_fail, mesh=mesh, legend_par=legendparcategorized_2)  # -> mesh, legend, title, colors, legend_par, vis_set; disabled; plug-in component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
toggle_4 = GroupToggle(ToggleActive=True, ToggleVisible=False)  # disabled

heatmap_5 = LBSpatialHeatmap(values=expression, mesh=mesh, legend_par=legendparcategorized_3)  # -> mesh, legend, title, colors, legend_par, vis_set; disabled; plug-in component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
toggle_5 = GroupToggle(ToggleActive=True, ToggleVisible=False)  # disabled

sort_2 = SortList(Keys=data_19)  # -> Keys, ValuesA
ma_5 = MassAddition(Input=data_19)  # -> Result, PartialResults
lng_3 = ListLength(List=data_19)
item_6 = ListItem(List=sort_2.Keys, Index=0, Wrap=True)  # -> Item1, Item
division = Division(A=ma_5.Result, B=lng_3)
max_min = Panel([item_6.Item1, item_6.Item])
average_df = Panel(division)

image_folder = Panel("C:\Users\Luigi\OneDrive - Eckersley O'Callaghan\Desktop")
falsestart_3 = LBFalseStartToggle(False)
sda_threshold = Panel("""75
55""")
ase_threshold = Panel("10")
py3_5 = Python3Script(
    sDA=sda_4,
    ASE=ase_2,
    sDA_threshold=sda_threshold,
    ASE_threshold=ase_threshold,
    Preview_in_Rhino=Toggle(False),
    Image_folder=image_folder,
    Save_image=falsestart_3)  # -> out, points, lines, text, image_fullpath; inputs sDA: list of Double, ASE: list of Double, sDA_threshold: list of Double, ASE_threshold: list of Double, Preview_in_Rhino: Boolean, Image_folder: String, Save_image: Boolean
# ---------- py3_5: Python ----------
# r: matplotlib

import matplotlib as mpl
import matplotlib.pyplot as plt
from datetime import datetime

# input data
sDA = [i for i in sDA if i is not None]
ASE = [i for i in ASE if i is not None]

sDA_knots = [100] + sDA_threshold
ASE_knots = [0] + ASE_threshold

### CHART IMAGE ###
if Save_image:
    fig, ax = plt.subplots(figsize=(5,5))
    if len(sDA) != 0 and len(ASE) != 0:
        for ASE_i, sDA_i in zip(ASE, sDA):
            ax.scatter(ASE_i, sDA_i,
                    c='r',
                    marker='x',
                    clip_on=False,
                    zorder=3)

    for sDA_thr in sDA_threshold:
        ax.plot((0,100),(sDA_thr, sDA_thr),
                c='k',
                ls='--',
                lw=0.5)
        ax.text(99, sDA_thr, f'sDA {sDA_thr:.0f}%', 
                style='italic',
                fontsize=7,
                color='gray',
                rotation='horizontal',
                ha='right',
                va='bottom')
    for ASE_thr in ASE_threshold:
        ax.plot((ASE_thr, ASE_thr),(0,100),
                c='k',
                ls='--',
                lw=0.5)
        ax.text(ASE_thr, 1, f'ASE {ASE_thr:.0f}%', 
                style='italic',
                fontsize=7,
                color='gray',
                rotation='vertical',
                ha='right',
                va='bottom')


    ticks = [i for i in range(0, 110, 10)]
    labels = [f'{i:.0f}' for i in ticks]

    ax.set_xlim(0, 100)
    ax.set_xticks(ticks)
    ax.set_xticklabels(labels)
    ax.set_xlabel('ASE [%]', fontweight='bold')

    ax.set_ylim(0, 100)
    ax.set_yticks(ticks)
    ax.set_yticklabels(labels)
    ax.set_ylabel('sDA [%]', fontweight='bold')

    ax.tick_params(axis='both',
                    which='both',
                    length=0)

    ax.grid(ls=':',
            lw=0.5, 
            c='gray')

    # patches
    patch_count = 0
    start_color = [0, 1, 0, 0.5]
    color_step = 0.3
    for sDA_k1, sDA_k2 in zip(sDA_knots, sDA_knots[1:]):
        for ASE_k1, ASE_k2 in zip(ASE_knots, ASE_knots[1:]):

            color = [i - patch_count*color_step for i in start_color[:3]] #+ [start_color[3]]
            color = [max(0,i) for i in color]
            color = [min(i, 1) for i in color]
            color = color + [start_color[3]]

            patch = plt.Rectangle((ASE_k1, sDA_k1),
                                    (ASE_k2 - ASE_k1),
                                    (sDA_k2 - sDA_k1),
                                    facecolor=color,
                                    zorder=0)
            ax.add_artist(patch)
            patch_count += 1

    if Save_image:
        if not Image_folder:
            print("please provide a valid folder to save the chart image")
        else:
            t0 = datetime.now()
            time = t0.strftime('%Y.%m.%d_%H-%M-%S')
            image_name = f'{time} sDA_ASE_Chart.png'
            image_fullpath = Image_folder + '\\' + image_name 
            plt.savefig(image_fullpath,
                        dpi=300,
                        bbox_inches='tight')
            print(f"Image saved at {image_fullpath}")



### CHART PREVIEW IN RHINO ###
if Preview_in_Rhino:

    import rhinoscriptsyntax as rs
    import Rhino.Geometry as rg
    import System.Drawing as sd
    import math

    # input data
    x_dim = 25
    y_dim = 25
    start_color = [0, 255, 0, 127]
    color_step = 100
    
    ### FUNCTIONS ###
    def text_func(loc, txt, height, rotation, justification):

        loc_x, loc_y, loc_z = loc
        loc = rs.coerce3dpoint(rs.AddPoint(loc_x, loc_y, loc_z))
        txt = str(txt) if type(txt) is not str else txt

        # 1. Create a Plane at the location
        plane = rg.Plane.WorldXY
        plane.Origin = loc
        plane.Rotate(math.radians(rotation),
                    plane.ZAxis,
                    plane.Origin)

        # 2. Create the Text Entity as flat, vector text in the GH preview
        te = rg.TextEntity()
        te.Plane = plane
        te.Text = txt
        te.FontIndex = 0 # Default font
        te.TextHeight = height # float

        if justification == 'TopRight':
            te.Justification = rg.TextJustification.TopRight
        elif justification == 'TopCenter':
            te.Justification = rg.TextJustification.TopCenter
        elif justification == 'TopLeft':
            te.Justification = rg.TextJustification.TopLeft 
        elif justification == 'MiddleRight':
            te.Justification = rg.TextJustification.MiddleRight
        elif justification == 'MiddleCenter':
            te.Justification = rg.TextJustification.MiddleCenter
        elif justification == 'MiddleLeft':
            te.Justification = rg.TextJustification.MiddleLeft
        elif justification == 'BottomRight':
            te.Justification = rg.TextJustification.BottomRight
        elif justification == 'BottomCenter':
            te.Justification = rg.TextJustification.BottomCenter
        elif justification == 'BottomLeft':
            te.Justification = rg.TextJustification.BottomLeft

        return te


    ### CHART PREVIEW ###
    # output data
    points = []
    lines = []
    text = []

    # sorting lists
    sDA_threshold = sorted(sDA_threshold, reverse = True)
    ASE_threshold = sorted(ASE_threshold, reverse = True)

    # Rectangle
    BL = rs.AddPoint(0,     0)
    BR = rs.AddPoint(x_dim, 0)
    TR = rs.AddPoint(x_dim, y_dim)
    TL = rs.AddPoint(0,     y_dim)
    edge_B = rs.AddLine(BL, BR)
    edge_R = rs.AddLine(BR, TR)
    edge_T = rs.AddLine(TR, TL)
    edge_L = rs.AddLine(TL, BL)
    lines.append(edge_B)
    lines.append(edge_R)
    lines.append(edge_L)
    lines.append(edge_T)

    # Hatches
    patch_count = 0
    sDA_knots = [100] + sDA_threshold
    ASE_knots = [0] + ASE_threshold

    for sDA_k1, sDA_k2 in zip(sDA_knots, sDA_knots[1:]):
        for ASE_k1, ASE_k2 in zip(ASE_knots, ASE_knots[1:]):

            sDA_k1 = sDA_k1*y_dim/100
            sDA_k2 = sDA_k2*y_dim/100
            ASE_k1 = ASE_k1*x_dim/100
            ASE_k2 = ASE_k2*x_dim/100
            color = [i - patch_count*color_step for i in start_color[:3]] #+ [start_color[3]]
            color = [max(0,i) for i in color]
            color = [min(i, 255) for i in color]
            color = color + [start_color[3]]

            pt_0 = rs.AddPoint(ASE_k1, sDA_k1)
            pt_1 = rs.AddPoint(ASE_k1, sDA_k2)
            pt_2 = rs.AddPoint(ASE_k2, sDA_k2)
            pt_3 = rs.AddPoint(ASE_k2, sDA_k1)
            pt_list = rs.coerce3dpointlist([pt_0, pt_1, pt_2, pt_3])
            mesh = rs.AddMesh(pt_list,
                            [[0,1,2,3]],
                            vertex_colors = [color, color, color, color])
            lines.append(mesh)
            patch_count += 1

    # Thresholds
    for sDA_thr in sDA_threshold:
        sDA_line = rs.AddLine(rs.AddPoint(0, sDA_thr*y_dim/100),
                            rs.AddPoint(x_dim, sDA_thr*y_dim/100))
        lines.append(sDA_line)
        text_sDA = text_func([x_dim - 0.25, sDA_thr*y_dim/100 + 0.25, 0],
                            f'sDA {sDA_thr:.0f}%',
                            0.35,
                            0,
                            'BottomRight')    
        text.append(text_sDA)
    for ASE_thr in ASE_threshold:
        ASE_line = rs.AddLine(rs.AddPoint(ASE_thr*x_dim/100, 0),
                            rs.AddPoint(ASE_thr*x_dim/100, y_dim))
        lines.append(ASE_line)

        text_ASE = text_func([ASE_thr*x_dim/100 -0.25, 0.25, 0],
                            f'ASE {ASE_thr:.0f}%',
                            0.35,
                            90,
                            'BottomLeft')    
        text.append(text_ASE)

    # Points
    if len(sDA) != 0 and len(ASE) != 0:
        print(len(sDA), len(ASE))
        for sDA_i, ASE_i in zip(sDA, ASE):
            pt = rs.AddPoint(ASE_i*x_dim/100, sDA_i*y_dim/100)
            points.append(pt)
    
    # Labels
    for pos_x in range(0, 110, 10):
        text_x = text_func([pos_x*x_dim/100, -0.5, 0],
                            f'{pos_x}%',
                            0.5,
                            90,
                            'MiddleRight')
        text.append(text_x)
    for pos_y in range(0, 110, 10):
        text_y = text_func([-0.5, pos_y*y_dim/100, 0],
                            f'{pos_y}%',
                            0.5,
                            0,
                            'MiddleRight')    
        text.append(text_y)
# ---------- end py3_5 ----------
preview_4 = CustomPreview(Geometry=py3_5.points, Material=ColourSwatch(SwatchColor=RGB(255, 0, 0)))
preview_5 = CustomPreview(Geometry=[py3_5.lines, py3_5.text], Material=ColourSwatch(SwatchColor=RGB(0, 0, 0)))
imageviewer = LBImageViewer(ImagePath_=py3_5.image_fullpath, _scale_=1, DisableClickable=False, SaveImgWithCoords=False, scale=1)  # -> ImagePath, Values, GIF
