# Grasshopper definition Roof model.gh (Grasshopper 1.0.8)
# plug-ins: Pufferfish, Telepathy

crv = Curve(<curve referenced from the Rhino model>)
crv_2 = Curve(<curve referenced from the Rhino model>)
skylight = RemoteSender(crv)
join = JoinCurves(Curves=crv_2, Preserve=False)
Z = UnitZ(Factor=Slider(4.67, range=0..10))
move = Move(Geometry=join, Motion=Z)  # -> Geometry, Transform
Z_2 = UnitZ(Factor=Slider(0.16, range=0..10))
clscrv = CloseCurve(Curve=move.Geometry, CloseType=0, Bulge=0.5, Tolerance=0)  # -> Closed, R
move_2 = Move(Geometry=move.Geometry, Motion=Z_2)  # -> Geometry, Transform
extr = Extrude(Base=move.Geometry, Direction=Z_2)
boundary = BoundarySurfaces(Edges=clscrv.Closed)
explode = Explode(Curve=move_2.Geometry, Recursive=True)  # -> Segments, Vertices
arc = CircularArc(explode.Segments)
skylight_2 = RemoteReceiver(skylight)
end = EndPoints(Curve=arc)  # -> Start, End
end_2 = EndPoints(Curve=move_2.Geometry)  # -> Start, End
project = ProjectCurve(Curve=skylight_2, Brep=boundary, Direction=Vector(0, 0, 1))
pipeline = GeometryPipeline(
    GroupByLayer=False,
    GroupByType=False,
    IncludeHidden=True,
    IncludeLocked=True,
    LayerFilter="EOC::Ridge Pts",
    NameFilter="*",
    SublayerFiltering=True,
    TypeFilter=1)
merge = Merge(Data1=end.Start, Data2=end.End, Data3=end_2.Start, Data4=end_2.End)  # -> flatten(Result)
clscrv_2 = CloseCurve(Curve=project, CloseType=0, Bulge=0.5, Tolerance=0)  # -> Closed, R
base = RemoteSender(project)
crv_3 = Curve(reparameterize(move_2.Geometry))
alongcrv = SortAlongCurve(Points=merge, Curve=move_2.Geometry)  # -> Points, Indices
rdiff = RegionDifference(CurvesA=clscrv.Closed, CurvesB=clscrv_2.Closed)
partition = PartitionList(List=alongcrv.Points, Size=3)
boundary_2 = BoundarySurfaces(Edges=flatten(rdiff))
crv_cp = CurveClosestPoint(Point=alongcrv.Points, Curve=crv_3)  # -> Point, Parameter, Distance
shatter = Shatter(Curve=crv_3, Parameters=crv_cp.Parameter)
ln = Line(StartPoint=partition, EndPoint=graft(pipeline))  # -> flatten(Line)
shift = ShiftList(List=ln, Shift=1, Wrap=False)
shift_2 = ShiftList(List=ln, Shift=-1, Wrap=False)
merge_2 = Merge(Data1=graft(shift), Data2=graft(shift_2))
swp1 = Sweep1(Rail=graft(shatter), Sections=merge_2, Miter=1)

data = Data(flatten(swp1))
area = Area(Geometry=data)  # -> Area, Centroid
sort = SortList(Keys=area.Area, ValuesA=data)  # -> Keys, reverse(ValuesA)
skylight_3 = RemoteReceiver(skylight)
item = ListItem(List=sort.ValuesA, Index=0, Wrap=True)
project_2 = ProjectCurve(Curve=skylight_3, Brep=item, Direction=Vector(0, 0, 1))
clscrv_3 = CloseCurve(Curve=project_2, CloseType=0, Bulge=0.5, Tolerance=0)  # -> Closed, R
rdiff_2 = RegionDifference(CurvesA=item, CurvesB=clscrv_3.Closed)
cull_i = CullIndex(List=sort.ValuesA, Indices=0, Wrap=True)
boundary_3 = BoundarySurfaces(Edges=flatten(rdiff_2))
merge_3 = Merge(Data1=boundary_3, Data2=cull_i)

base_2 = RemoteReceiver(base)
merge_4 = Merge(Data1=project_2, Data2=base_2)  # -> flatten(Result)
loft = Loft(Curves=merge_4, Options={Adjust=False, Closed=False, LoftEnds=0, LoftSimp=0, LoftType=0, Rebuild=10, Refit=0.01})
debrep = DeconstructBrep(Brep=loft)  # -> Faces, Edges, Vertices
merge_5 = Merge(Data1=boundary_2, Data2=extr, Data3=merge_3)  # -> flatten(Result)

data_2 = Data(debrep.Faces)
bbox = BoundingBox(Content=flatten(data_2), Plane=PlaneXY(0, 0, 0), UnionBox=True)  # -> Box, Box_2
debrep_2 = DeconstructBrep(Brep=data_2)  # -> simplify(Faces), Edges, Vertices
md_slider = MDSlider(SliderMode=0, slider_value=Point(0.5, 0.5, 0.5), x_domain=Domain(0, 1), y_domain=Domain(0, 1), z_domain=Domain(0, 1))
volume = Volume(Geometry=bbox.Box)  # -> Volume, Centroid
pt = Point(volume.Centroid)
evalsrf = EvaluateSurface(Surface=reparameterize(graft(debrep_2.Faces)), Point=md_slider)  # -> Point, simplify(Normal), UDirection, VDirection, Frame
vec2pt = Vector2Pt(PointA=evalsrf.Point, PointB=pt, Unitize=False)  # -> Vector, Length
multiplication = Multiplication(A=evalsrf.Normal, B="10")
dprod = DotProduct(VectorA=vec2pt.Vector, VectorB=evalsrf.Normal, Unitize=True)
vdis = VectorDisplay(Anchor=evalsrf.Point, Vector=multiplication)
smaller = SmallerThan(FirstNumber=dprod, SecondNumber=0)  # -> SmallerThan, OrEqualTo
sift = SiftPattern(List=graft(data_2), SiftPattern=smaller.SmallerThan)  # -> Output0, Output1
flip = Flip(Surface=sift.Output1)  # -> Surface, Result
combine = CombineData(Input0=sift.Output0, Input1=flip.Surface)  # -> Result, Index
pshift = ShiftPaths(Data=combine.Result, Offset=-1)

data_3 = Data(merge_5)
bbox_2 = BoundingBox(Content=flatten(data_3), Plane=PlaneXY(0, 0, 0), UnionBox=True)  # -> Box, Box_2
debrep_3 = DeconstructBrep(Brep=data_3)  # -> simplify(Faces), Edges, Vertices
md_slider_2 = MDSlider(SliderMode=0, slider_value=Point(0.5, 0.5, 0.5), x_domain=Domain(0, 1), y_domain=Domain(0, 1), z_domain=Domain(0, 1))
volume_2 = Volume(Geometry=bbox_2.Box)  # -> Volume, Centroid
evalsrf_2 = EvaluateSurface(Surface=reparameterize(graft(debrep_3.Faces)), Point=md_slider_2)  # -> Point, simplify(Normal), UDirection, VDirection, Frame
pt_2 = Point(volume_2.Centroid)
vec2pt_2 = Vector2Pt(PointA=evalsrf_2.Point, PointB=pt_2, Unitize=False)  # -> Vector, Length
multiplication_2 = Multiplication(A=evalsrf_2.Normal, B="10")
dprod_2 = DotProduct(VectorA=vec2pt_2.Vector, VectorB=evalsrf_2.Normal, Unitize=True)
vdis_2 = VectorDisplay(Anchor=evalsrf_2.Point, Vector=multiplication_2)
smaller_2 = SmallerThan(FirstNumber=dprod_2, SecondNumber=0)  # -> SmallerThan, OrEqualTo
sift_2 = SiftPattern(List=graft(data_3), SiftPattern=smaller_2.SmallerThan)  # -> Output0, Output1
flip_2 = Flip(Surface=sift_2.Output0)  # -> Surface, Result
combine_2 = CombineData(Input0=flip_2.Surface, Input1=sift_2.Output1)  # -> Result, Index
pshift_2 = ShiftPaths(Data=combine_2.Result, Offset=-1)

panel = Panel(sift.Output1)

# ---- group: Skylight
boundary_4 = BoundarySurfaces(Edges=flatten(clscrv_3.Closed))

# ----
number_slider = Slider(1.4, range=0..100)

debrep_4 = DeconstructBrep(Brep=boundary_4)  # -> simplify(Faces), Edges, Vertices
md_slider_3 = MDSlider(SliderMode=0, slider_value=Point(0.5, 0.5, 0.5), x_domain=Domain(0, 1), y_domain=Domain(0, 1), z_domain=Domain(0, 1))
evalsrf_3 = EvaluateSurface(Surface=reparameterize(graft(debrep_4.Faces)), Point=md_slider_3)  # -> Point, simplify(Normal), UDirection, VDirection, Frame
multiplication_3 = Multiplication(A=evalsrf_3.Normal, B=number_slider)
vdis_3 = VectorDisplay(Anchor=evalsrf_3.Point, Vector=multiplication_3)

debrep_5 = DeconstructBrep(Brep=pshift)  # -> simplify(Faces), Edges, Vertices
md_slider_4 = MDSlider(SliderMode=0, slider_value=Point(0.5, 0.5, 0.5), x_domain=Domain(0, 1), y_domain=Domain(0, 1), z_domain=Domain(0, 1))
evalsrf_4 = EvaluateSurface(Surface=reparameterize(graft(debrep_5.Faces)), Point=md_slider_4)  # -> Point, simplify(Normal), UDirection, VDirection, Frame
multiplication_4 = Multiplication(A=evalsrf_4.Normal, B=number_slider)
vdis_4 = VectorDisplay(Anchor=evalsrf_4.Point, Vector=multiplication_4)

debrep_6 = DeconstructBrep(Brep=pshift_2)  # -> simplify(Faces), Edges, Vertices
md_slider_5 = MDSlider(SliderMode=0, slider_value=Point(0.5, 0.5, 0.5), x_domain=Domain(0, 1), y_domain=Domain(0, 1), z_domain=Domain(0, 1))
evalsrf_5 = EvaluateSurface(Surface=reparameterize(graft(debrep_6.Faces)), Point=md_slider_5)  # -> Point, simplify(Normal), UDirection, VDirection, Frame
multiplication_5 = Multiplication(A=evalsrf_5.Normal, B=Slider(1.4, range=0..100))
vdis_5 = VectorDisplay(Anchor=evalsrf_5.Point, Vector=multiplication_5)
