# Grasshopper definition Thermal Zones.gh (Grasshopper 1.0.8)

pipeline = GeometryPipeline(
    GroupByLayer=False,
    GroupByType=False,
    IncludeHidden=True,
    IncludeLocked=True,
    LayerFilter="Areas",
    NameFilter="*",
    SublayerFiltering=True,
    TypeFilter=4)
lng = ListLength(List=pipeline)  # -> expr("x+1", Length)
dom = ConstructDomain(DomainStart=Slider(0, range=0..1), DomainEnd=Slider(1, range=0..1))
range = Range(Domain=dom, Steps=lng)
cull_i = CullIndex(List=range, Indices=[0, -1], Wrap=True)
jitter = Jitter(List=cull_i, Jitter=1, Seed=Slider(36, range=0..100))  # -> Values, Indices
gradient = Gradient(
    LowerLimit=0,
    UpperLimit=1,
    Parameter=jitter.Values,
    stops=[0: RGB(243, 57, 0), 0.1: RGB(236, 27, 60), 0.2: RGB(210, 0, 118), 0.3: RGB(103, 0, 120), 0.4: RGB(39, 72, 161), 0.5: RGB(1, 192, 229), 0.6: RGB(18, 178, 90), 0.7: RGB(79, 186, 8), 0.8: RGB(220, 237, 32), 0.9: RGB(247, 159, 20), 1: RGB(243, 57, 0)])
area = Area(Geometry=pipeline)  # -> expr("Round(x,2)", Area), Centroid
boundary = BoundarySurfaces(Edges=pipeline)
ma = MassAddition(Input=area.Area)  # -> Result, PartialResults
tag = TextTag3D(Location=area.Centroid, Text=area.Area, Size=1, Justification=7)
preview = CustomPreview(Geometry=boundary, Material=gradient)
panel = Panel(ma.Result)
